# Dynamo graph ALIGN VIEWS WITH REFERENCE VIEW.dyn (Dynamo 1.3.2.2480)

# group: input
code_block = CodeBlock { "OST_Viewports"; }
byName = Category.ByName(code_block)
# note: Instrucciones:
# 1. Descargar nodo SteamNode de Paquetes>Buscar un paquete
# 2. Crear un plano en Revit para usarlo de referencia. Poner en ella sólo una vista que servirá de referencia para colocar los nuevas vistas en los planos.
# 3. Preparar la vista con una caja de referencia asignada en Propiedades>Extensión>Caja de referencia. Para crear dicha caja de de referencia; Vista>Crear>Caja de referencia
# 4. Seleccionar Cuadro de rotulación, Tipo de vista a usar, Plano de referencia a usar, escribir alguna/s palabra/s clave para el filtrado de vistas y el nombre de los planos al que automáticamente se les numerará.
code_block_2 = CodeBlock { "OST_Sheets"; }
byName_2 = Category.ByName(code_block_2)
all_elements_of_category = ElementsOfCategory(byName_2)

isolated_pick_model_elements = Custom[Isolated Pick Model Elements](Category=byName)  # This allows a multiple selection of elements of specified category.

# group: filter input sheets
sheetNumber = Sheet.SheetNumber(all_elements_of_category)
string_from_object = FromObject(sheetNumber)
palabra_s_clave_filtrado_planos = StringInput("I")
code_block_3 = CodeBlock { true; }
contains = String.Contains(str=string_from_object, searchFor=palabra_s_clave_filtrado_planos, ignoreCase=code_block_3)
filterByBoolMask = List.FilterByBoolMask(list=all_elements_of_category, mask=contains)

# group: get viewports from filtered sheets
getViewportsAndViews = RevitElements.Sheet.GetViewportsAndViews(filterByBoolMask.in)
getView = RevitElements.Viewport.GetView(getViewportsAndViews@L2)
flatten = Flatten(getView@L2)

# group: filter viewports
string_from_object_2 = FromObject(flatten)
palabra_s_clave_filtrado_vistas = StringInput("1/500")
code_block_4 = CodeBlock { true; }
contains_2 = String.Contains(str=string_from_object_2, searchFor=palabra_s_clave_filtrado_vistas, ignoreCase=code_block_4)
filterByBoolMask_2 = List.FilterByBoolMask(list=getViewportsAndViews, mask=contains_2)
flatten_2 = Flatten(filterByBoolMask_2.in)

# group: get point of reference viewport
viewPortBoxCenter = Custom[View.ViewPortBoxCenter](Viewports=isolated_pick_model_elements)  # Get ViewPort Box center point
count = Count(flatten_2)
cycle = List.Cycle(list=viewPortBoxCenter, amount=count)

setBoxCenter = Custom[Viewport.SetBoxCenter](Points=cycle, Viewport_list=flatten_2)  # API class
