# Dynamo graph ASSIGN FINISHES TO ROOMS BY OCCUPANCY.dyn (Dynamo 1.2.1.3083)

# group: USER INTERFACE
# note: INPUT + CONTROL

# group: DESIGN
# note: BACK-END FUNCTIONALITY

# group: INSTRUCTIONS
# note: INSTRUCTIONS:
# 1. Input the floor finishes in the yellow group. Make sure that there is a floor type in Revit that has exactly the same name than the one you write down
# 2. Click Run

# group: WIP
# note: USE:
# FOR UNFINISHED OR UNTESTED
# NODE BLOCKS
# note: WIP

# group: COMMENTS
# note: USE:
# FOR ANY COMMENTS OR PROJECT INFO
# note: COMMENTS

# group: TO REVIT
# note: USE:
# FOR ANY NODE THAT
# EXPORTS DATA TO REVIT
# note: TO REVIT

# group: INPUT
# note: USE:
# FOR FIXED INPUTS, LIKE FILE PATHS OR FIXED NUMBERS OR ELEMENTS THAT NEEDS TO BE
# TYPED BY THE FINAL USER
# note: INPUT

# group: CONTROL
# note: FIXED INPUTS THAT DICTATE WHAT
# THE SCRIPT IS USEFUL FOR
# note: CONTROL

# group: DESIGN
# note: USE:
# FOR GENERAL DEFINITIONS OF NODE BLOCKS
# note: DESIGN

# group: SELECT ALL ROOMS
# note: CREATED BY:
# CREATED: 2018.10.11
# VERSION: 1.0
# LAST EDITED: 2019.01.09
# DYNAMO VERSION: Dynamo 1.2.0
# PACKAGES:
# None
# NOTES:
# <NOTES>
code_block = CodeBlock { "OST_Rooms"; }
byName = Category.ByName(code_block)
all_elements_of_category = ElementsOfCategory(byName)
watch = Watch(all_elements_of_category)

# group: INPUT, TYPE OF FLOOR FINISH (MAKE SURE THAT THERE IS A PHYSICAL FLOOR IN THE PROJECT WITH THE SAME NAME)
floor_finish_for_common_areas = StringInput("I-CP100 CARPET TILE")
floor_finish_for_resident_suites = StringInput("I-CP102 CARPET TILE")
floor_finish_for_ensuites = StringInput("I-VY330 NON SLIP VINYL R10")
floor_finish_for_common_w_c_s = StringInput("I-VY330 NON SLIP VINYL R10")  # "Floor finish for COMMON W/C'S & STAFF CHANGE"
floor_finish_for_wet_service = StringInput("I-VY331 NON SLIP VINYL R10")  # "Floor finish for WET SERVICE ROOMS"
floor_finish_for_service_rooms = StringInput("I-CP101 CARPET TILE")
floor_finish_for_store_rooms_st = StringInput("I-VY330 NON SLIP VINYL R10")  # "Floor finish for STORE ROOMS ST-E"
floor_finish_for_store_rooms_st_2 = StringInput("I-VY331 NON SLIP VINYL R10")  # "Floor finish for STORE ROOMS ST-L, COMMS & ARCHIVE"
floor_finish_for_staff_rooms = StringInput("I-VY330 NON SLIP VINYL R10")
floor_finish_for_b_o_h_egress = StringInput("I-VY331 NON SLIP VINYL R10")  # "Floor finish for B.O.H/EGRESS STAIRS/DELIVERIES/MAINTENANCE"

# group: FINISHES ACCORDING TO USE
code_block_2 = CodeBlock { "Use"; }
common_areas = CodeBlock(floorFinish=floor_finish_for_common_areas)
# ---------- common_areas.designscript (8 lines) ----------
"F1";
"1x COAT SEALER, 2x COAT FLAT ACRYLIC";
"1x COAT SEALER, 2x COAT FLAT ACRYLIC";
"1x COAT SEALER, 3x COAT SEMIGLOSS";

"COMMON AREAS";
"F1 - COMMON AREAS";
floorFinish;
# ----------------------------------------
resident_suites = CodeBlock(floorFinish=floor_finish_for_resident_suites)
# ---------- resident_suites.designscript (8 lines) ----------
"F2";
"1x COAT SEALER, 2x COAT FLAT ACRYLIC";
"1x COAT SEALER, 2x COAT FLAT ACRYLIC";
"1x COAT SEALER, 3x COAT SEMIGLOSS";

"RESIDENT SUITES";
"F2 - RESIDENT SUITES";
floorFinish;
# ----------------------------------------
ENSUITES = CodeBlock(floorFinish=floor_finish_for_ensuites)
# ---------- ENSUITES.designscript (8 lines) ----------
"F3";
"1x COAT SEALER, 2x COAT FLAT ACRYLIC";
"WATERPROOFING, FULL HEIGHT WALL TILE";
"WATERPROOFING, VINYL";

"ENSUITES";
"F3 - ENSUITES";
floorFinish;
# ----------------------------------------
common_w_c_s_staff_change = CodeBlock(floorFinish=floor_finish_for_common_w_c_s)
# ---------- common_w_c_s_staff_change.designscript (8 lines) ----------
"F4";
"1x COAT SEALER, 2x COAT SEMIGLOSS ENAMEL";
"1x COAT SEALER, 2x FLAT ACRYLIC";
"VINYL";

"COMMON W/C'S & STAFF CHANGE";
"F4 - COMMON W/C'S & STAFF CHANGE";
floorFinish;
# ----------------------------------------
wet_service_rooms = CodeBlock(floorFinish=floor_finish_for_wet_service)
# ---------- wet_service_rooms.designscript (8 lines) ----------
"F5";
"1x COAT SEALER, 2x COAT SEMIGLOSS ENAMEL";
"WATERPROOFING, FULL HEIGHT WALL TILE";
"VINYL";

"WET SERVICE ROOMS";
"F5 - WET SERVICE ROOMS";
floorFinish;
# ----------------------------------------
service_rooms = CodeBlock(floorFinish=floor_finish_for_service_rooms)
# ---------- service_rooms.designscript (8 lines) ----------
"F6";
"1x COAT SEALER, 2x COAT SEMIGLOSS ENAMEL";
"1x COAT SEALER, 2x COAT FLAT ACRYLIC";
"VINYL";

"SERVICE ROOMS";
"F6 - SERVICE ROOMS";
floorFinish;
# ----------------------------------------
store_rooms_st_e = CodeBlock(floorFinish=floor_finish_for_store_rooms_st)
# ---------- store_rooms_st_e.designscript (8 lines) ----------
"F7";
"1x COAT SEALER, 2x COAT FLAT ACRYLIC";
"1x COAT SEALER, 2x COAT FLAT ACRYLIC";
"VINYL";

"STORE ROOMS ST-E";
"F7 - STORE ROOMS ST-E";
floorFinish;
# ----------------------------------------
store_rooms_st_l_comms_archive = CodeBlock(floorFinish=floor_finish_for_store_rooms_st_2)
# ---------- store_rooms_st_l_comms_archive.designscript (8 lines) ----------
"F8";
"1x COAT SEALER, 2x COAT FLAT ACRYLIC";
"1x COAT SEALER, 2x COAT FLAT ACRYLIC";
"1x COAT SEALER, 3x COAT SEMIGLOSS";

"STORE ROOMS ST-L, COMMS & ARCHIVE";
"F8 - STORE ROOMS ST-L, COMMS & ARCHIVE";
floorFinish;
# ----------------------------------------
staff_rooms = CodeBlock(floorFinish=floor_finish_for_staff_rooms)
# ---------- staff_rooms.designscript (8 lines) ----------
"F9";
"1x COAT SEALER, 2x COAT FLAT ACRYLIC";
"1x COAT SEALER, 2x COAT SATIN ACRYLIC WASHABLE";
"VINYL";

"STAFF ROOMS";
"F9 - STAFF ROOMS";
floorFinish;
# ----------------------------------------
b_o_h_egress_stairs_deliveries = CodeBlock(floorFinish=floor_finish_for_b_o_h_egress)  # "B.O.H/EGRESS STAIRS/DELIVERIES/MAINTENANCE"
# ---------- b_o_h_egress_stairs_deliveries.designscript (8 lines) ----------
"F10";
"1x COAT SEALER, 2x COAT FLAT ACRYLIC";
"1x COAT SEALER, 2x COAT SATIN ACRYLIC WASHABLE";
"";

"B.O.H";
"F10 - B.O.H/EGRESS STAIRS/DELIVERIES/MAINTENANCE";
floorFinish;
# ----------------------------------------

# group: FILTER COMMON ROOMS
getParameterValueByName = Element.GetParameterValueByName(element=watch, parameterName=code_block_2)
eq = getParameterValueByName == common_areas.out4
filterByBoolMask = List.FilterByBoolMask(list=watch, mask=eq)

# group: WRITE PARAMETERS INTO REVIT
room_finishes_base_ceiling_wall = Custom[Room Finishes (Base, Ceiling, Wall, Trim)](Rooms=filterByBoolMask.in, Base_Finish=common_areas.out0, Ceiling_Finish=common_areas.out1, Wall_Finish=common_areas.out2, Trim_Finish=common_areas.out3, Base_Finish_Occupancy=common_areas.out5, Floor_Finish=common_areas.floorFinish)

# group: FILTER COMMON ROOMS
getParameterValueByName_2 = Element.GetParameterValueByName(element=watch, parameterName=code_block_2)
startsWith = String.StartsWith(str=getParameterValueByName_2, searchFor=resident_suites.out4)
filterByBoolMask_2 = List.FilterByBoolMask(list=watch, mask=startsWith)

# group: WRITE PARAMETERS INTO REVIT
room_finishes_base_ceiling_wall_2 = Custom[Room Finishes (Base, Ceiling, Wall, Trim)](Rooms=filterByBoolMask_2.in, Base_Finish=resident_suites.out0, Ceiling_Finish=resident_suites.out1, Wall_Finish=resident_suites.out2, Trim_Finish=resident_suites.out3, Base_Finish_Occupancy=resident_suites.out5, Floor_Finish=resident_suites.floorFinish)

# group: FILTER COMMON ROOMS
getParameterValueByName_3 = Element.GetParameterValueByName(element=watch, parameterName=code_block_2)
startsWith_2 = String.StartsWith(str=getParameterValueByName_3, searchFor=ENSUITES.out4)
filterByBoolMask_3 = List.FilterByBoolMask(list=watch, mask=startsWith_2)

# group: WRITE PARAMETERS INTO REVIT
room_finishes_base_ceiling_wall_3 = Custom[Room Finishes (Base, Ceiling, Wall, Trim)](Rooms=filterByBoolMask_3.in, Base_Finish=ENSUITES.out0, Ceiling_Finish=ENSUITES.out1, Wall_Finish=ENSUITES.out2, Trim_Finish=ENSUITES.out3, Base_Finish_Occupancy=ENSUITES.out5, Floor_Finish=ENSUITES.floorFinish)

# group: FILTER COMMON ROOMS
getParameterValueByName_4 = Element.GetParameterValueByName(element=watch, parameterName=code_block_2)
startsWith_3 = String.StartsWith(str=getParameterValueByName_4, searchFor=common_w_c_s_staff_change.out4)
filterByBoolMask_4 = List.FilterByBoolMask(list=watch, mask=startsWith_3)

# group: WRITE PARAMETERS INTO REVIT
room_finishes_base_ceiling_wall_4 = Custom[Room Finishes (Base, Ceiling, Wall, Trim)](Rooms=filterByBoolMask_4.in, Base_Finish=common_w_c_s_staff_change.out0, Ceiling_Finish=common_w_c_s_staff_change.out1, Wall_Finish=common_w_c_s_staff_change.out2, Trim_Finish=common_w_c_s_staff_change.out3, Base_Finish_Occupancy=common_w_c_s_staff_change.out5, Floor_Finish=common_w_c_s_staff_change.floorFinish)

# group: FILTER COMMON ROOMS
getParameterValueByName_5 = Element.GetParameterValueByName(element=watch, parameterName=code_block_2)
startsWith_4 = String.StartsWith(str=getParameterValueByName_5, searchFor=wet_service_rooms.out4)
filterByBoolMask_5 = List.FilterByBoolMask(list=watch, mask=startsWith_4)

# group: WRITE PARAMETERS INTO REVIT
room_finishes_base_ceiling_wall_5 = Custom[Room Finishes (Base, Ceiling, Wall, Trim)](Rooms=filterByBoolMask_5.in, Base_Finish=wet_service_rooms.out0, Ceiling_Finish=wet_service_rooms.out1, Wall_Finish=wet_service_rooms.out2, Trim_Finish=wet_service_rooms.out3, Base_Finish_Occupancy=wet_service_rooms.out5, Floor_Finish=wet_service_rooms.floorFinish)

# group: FILTER COMMON ROOMS
getParameterValueByName_6 = Element.GetParameterValueByName(element=watch, parameterName=code_block_2)
startsWith_5 = String.StartsWith(str=getParameterValueByName_6, searchFor=service_rooms.out4)
filterByBoolMask_6 = List.FilterByBoolMask(list=watch, mask=startsWith_5)

# group: WRITE PARAMETERS INTO REVIT
room_finishes_base_ceiling_wall_6 = Custom[Room Finishes (Base, Ceiling, Wall, Trim)](Rooms=filterByBoolMask_6.in, Base_Finish=service_rooms.out0, Ceiling_Finish=service_rooms.out1, Wall_Finish=service_rooms.out2, Trim_Finish=service_rooms.out3, Base_Finish_Occupancy=service_rooms.out5, Floor_Finish=service_rooms.floorFinish)

# group: FILTER COMMON ROOMS
getParameterValueByName_7 = Element.GetParameterValueByName(element=watch, parameterName=code_block_2)
startsWith_6 = String.StartsWith(str=getParameterValueByName_7, searchFor=store_rooms_st_e.out4)
filterByBoolMask_7 = List.FilterByBoolMask(list=watch, mask=startsWith_6)

# group: WRITE PARAMETERS INTO REVIT
room_finishes_base_ceiling_wall_7 = Custom[Room Finishes (Base, Ceiling, Wall, Trim)](Rooms=filterByBoolMask_7.in, Base_Finish=store_rooms_st_e.out0, Ceiling_Finish=store_rooms_st_e.out1, Wall_Finish=store_rooms_st_e.out2, Trim_Finish=store_rooms_st_e.out3, Base_Finish_Occupancy=store_rooms_st_e.out5, Floor_Finish=store_rooms_st_e.floorFinish)

# group: FILTER COMMON ROOMS
getParameterValueByName_8 = Element.GetParameterValueByName(element=watch, parameterName=code_block_2)
startsWith_7 = String.StartsWith(str=getParameterValueByName_8, searchFor=store_rooms_st_l_comms_archive.out4)
filterByBoolMask_8 = List.FilterByBoolMask(list=watch, mask=startsWith_7)

# group: WRITE PARAMETERS INTO REVIT
room_finishes_base_ceiling_wall_8 = Custom[Room Finishes (Base, Ceiling, Wall, Trim)](Rooms=filterByBoolMask_8.in, Base_Finish=store_rooms_st_l_comms_archive.out0, Ceiling_Finish=store_rooms_st_l_comms_archive.out1, Wall_Finish=store_rooms_st_l_comms_archive.out2, Trim_Finish=store_rooms_st_l_comms_archive.out3, Base_Finish_Occupancy=store_rooms_st_l_comms_archive.out5, Floor_Finish=store_rooms_st_l_comms_archive.floorFinish)

# group: FILTER COMMON ROOMS
getParameterValueByName_9 = Element.GetParameterValueByName(element=watch, parameterName=code_block_2)
startsWith_8 = String.StartsWith(str=getParameterValueByName_9, searchFor=staff_rooms.out4)
filterByBoolMask_9 = List.FilterByBoolMask(list=watch, mask=startsWith_8)

# group: WRITE PARAMETERS INTO REVIT
room_finishes_base_ceiling_wall_9 = Custom[Room Finishes (Base, Ceiling, Wall, Trim)](Rooms=filterByBoolMask_9.in, Base_Finish=staff_rooms.out0, Ceiling_Finish=staff_rooms.out1, Wall_Finish=staff_rooms.out2, Trim_Finish=staff_rooms.out3, Base_Finish_Occupancy=staff_rooms.out5, Floor_Finish=staff_rooms.floorFinish)

# group: FILTER COMMON ROOMS
getParameterValueByName_10 = Element.GetParameterValueByName(element=watch, parameterName=code_block_2)
startsWith_9 = String.StartsWith(str=getParameterValueByName_10, searchFor=b_o_h_egress_stairs_deliveries.out4)
filterByBoolMask_10 = List.FilterByBoolMask(list=watch, mask=startsWith_9)

# group: WRITE PARAMETERS INTO REVIT
room_finishes_base_ceiling_wall_10 = Custom[Room Finishes (Base, Ceiling, Wall, Trim)](Rooms=filterByBoolMask_10.in, Base_Finish=b_o_h_egress_stairs_deliveries.out0, Ceiling_Finish=b_o_h_egress_stairs_deliveries.out1, Wall_Finish=b_o_h_egress_stairs_deliveries.out2, Trim_Finish=b_o_h_egress_stairs_deliveries.out3, Base_Finish_Occupancy=b_o_h_egress_stairs_deliveries.out5, Floor_Finish=b_o_h_egress_stairs_deliveries.floorFinish)
