# Dynamo graph CHANGE EXISTING DOORS GRAPHIC.dyn (Dynamo 1.2.1.3083)

# group: USER INTERFACE
# note: INPUT + CONTROL

# group: DESIGN
# note: BACK-END FUNCTIONALITY

# group: SCRIPT TITLE
# note: CREATED BY:
# CREATED: 2019.01.08
# VERSION: 1.0
# LAST EDITED: 2019.01.08
# DYNAMO VERSION: Dynamo 1.2.0
# PACKAGES:
# None
# NOTES:
# <NOTES>

# group: INSTRUCTIONS
# note: WARNING!
# BEFORE EXECUTING THE SCRIPT, SYNCHRONIZE WITH THE CENTRAL FILE OR SAVE YOUR PROJECT.
# This is because the script, in limited ocasions, can crash Revit and any unsaved change would be lost.
# INSTRUCTIONS:
# 1. Click Run

# group: WIP
# note: USE:
# FOR UNFINISHED OR UNTESTED
# NODE BLOCKS
# note: WIP

# group: COMMENTS
# note: USE:
# FOR ANY COMMENTS OR PROJECT INFO
# note: COMMENTS

# group: TO REVIT
# note: USE:
# FOR ANY NODE THAT
# EXPORTS DATA TO REVIT
# note: TO REVIT

# group: INPUT
# note: USE:
# FOR FIXED INPUTS, LIKE FILE PATHS OR FIXED NUMBERS OR ELEMENTS THAT NEEDS TO BE
# TYPED BY THE FINAL USER
# note: INPUT

# group: CONTROL
# note: FIXED INPUTS THAT DICTATE WHAT
# THE SCRIPT IS USEFUL FOR
# note: CONTROL

# group: DESIGN
# note: USE:
# FOR GENERAL DEFINITIONS OF NODE BLOCKS
# note: DESIGN

# group: SELECT ALL DOORS
code_block = CodeBlock { "OST_Doors"; }
byName = Category.ByName(code_block)
all_elements_of_category = ElementsOfCategory(byName)

# group: FILTER OUT DOORS WITHOUT EXISTING PARAMETER
code_block_2 = CodeBlock { "Existing"; }
getParameterValueByName = Element.GetParameterValueByName(element=all_elements_of_category, parameterName=code_block_2)
code_block_3 = CodeBlock { ""; }
eq = getParameterValueByName == code_block_3
filterByBoolMask = List.FilterByBoolMask(list=all_elements_of_category, mask=eq)

# group: SELECT EXISTING DOORS
code_block_4 = CodeBlock { "Phase Created"; }
getParameterValueByName_2 = Element.GetParameterValueByName(element=filterByBoolMask.out, parameterName=code_block_4)
check_for_matching_existing = Python(IN[0]=getParameterValueByName_2)  # "Check for matching existing phase"
# ---------- check_for_matching_existing.python (29 lines) ----------
import clr
clr.AddReference('RevitAPI')
from Autodesk.Revit.DB import *
import Autodesk

clr.AddReference("RevitNodes")
import Revit
clr.ImportExtensions(Revit.Elements)

clr.AddReference("RevitServices")
import RevitServices
from RevitServices.Persistence import DocumentManager

doc = DocumentManager.Instance.CurrentDBDocument
data = IN
phaseExisting = None
boolMask = list()
# Retrieve Existing phase from document
for phase in doc.Phases:
	if phase.Name == "Existing":
		phaseExisting = phase.ToDSType(True)
# Check if there is a match between input and existing phase
for element in data[0]:
	if phaseExisting == element:
		boolMask.append(True)
	else:
		boolMask.append(False)
# Output result
OUT = boolMask
# ----------------------------------------
filterByBoolMask_2 = List.FilterByBoolMask(list=filterByBoolMask.out, mask=check_for_matching_existing)

# group: SET EXISTING PARAMETER ACCORDINGLY
code_block_5 = CodeBlock { "Existing"; true; false; }
setParameterByName = Element.SetParameterByName(element=filterByBoolMask_2.in, parameterName=code_block_5.out0, value=code_block_5.out1)
setParameterByName_2 = Element.SetParameterByName(element=filterByBoolMask_2.out, parameterName=code_block_5.out0, value=code_block_5.out2)
