# Dynamo graph CREATE HATCH FOR CONCRETE SETOUTS.dyn (Dynamo 1.2.1.3083)

# group: USER INTERFACE
# note: INPUT + CONTROL

# group: DESIGN
# note: BACK-END FUNCTIONALITY

# group: HATCH CONCRETE SETOUTS
# note: CREATED BY:
# CREATED: 2018.08.15
# VERSION: 1.0
# LAST EDITED: 2018.12.20
# DYNAMO VERSION: Dynamo 1.2.0
# PACKAGES:
# None
# NOTES:
# <NOTES>

# group: INSTRUCTIONS
# note: INSTRUCTIONS:
# WARNINGS:
# IT DOES NOT WORK WITH ROOMS THAT HAS MORE THAN ONE CLOSED BOUNDARY. THIS MEANS TAHT NO COLUMN, WALL OR ANY OTHER ROOM BOUNDARY DELIMITER CAN GO INSIDE THE ROOM FOR THIS SCRIPT TO WORK. IF THERE IS ANY CASE LIKE THAT, FILLED REGIONS MUST BE CREATED BY HAND. THE BEST WAY TO CHEK IS APPLY A ROOM COLOR SCHEME AND CHECK WHAT IS MISSING.
# ALSO, DO NOT DELETE, UNGROUP OR UPDATE THE GROUP OF HATCHES. EVERYTIME THE SCRIPT IS RUN, IT WILL UPDATE THAT GROUP AND ANY CHANGE MADE BY HAND WILL BE LOST AFTER RERUNNING THE SCRIPT.
# 1. Enter View's Name in input
# 2. Click Run

# group: WIP
# note: USE:
# FOR UNFINISHED OR UNTESTED
# NODE BLOCKS
# note: WIP

# group: COMMENTS
# note: USE:
# FOR ANY COMMENTS OR PROJECT INFO
# note: COMMENTS

# group: TO REVIT
# note: USE:
# FOR ANY NODE THAT
# EXPORTS DATA TO REVIT
# note: TO REVIT

# group: INPUT
# note: USE:
# FOR FIXED INPUTS, LIKE FILE PATHS OR FIXED NUMBERS OR ELEMENTS THAT NEEDS TO BE
# TYPED BY THE FINAL USER
# note: INPUT

# group: CONTROL
# note: FIXED INPUTS THAT DICTATE WHAT
# THE SCRIPT IS USEFUL FOR
# note: CONTROL

# group: DESIGN
# note: USE:
# FOR GENERAL DEFINITIONS OF NODE BLOCKS
# note: DESIGN

# group: Select Placed Rooms
code_block = CodeBlock { "OST_Rooms"; }
byName = Category.ByName(code_block)
all_elements_of_category = ElementsOfCategory(byName)
area = Room.Area(all_elements_of_category)
code_block_2 = CodeBlock { 0; }
gt = area > code_block_2
filterByBoolMask = List.FilterByBoolMask(list=all_elements_of_category, mask=gt)

# group: Filter Setout rooms
code_block_3 = CodeBlock { "Room Setout"; }
getParameterValueByName = Element.GetParameterValueByName(element=filterByBoolMask.in, parameterName=code_block_3)
convertto_true_false_list = Python(IN[0]=getParameterValueByName)
# ---------- convertto_true_false_list.python (16 lines) ----------
import clr
clr.AddReference('ProtoGeometry')
from Autodesk.DesignScript.Geometry import *
#The inputs to this node will be stored as a list in the IN variables.
data = IN

resultList = list()

for element in data[0]:
	if element == 1:
		resultList.append(True)
	else:
		resultList.append(False)

#Assign your output to the OUT variable.
OUT = resultList
# ----------------------------------------
filterByBoolMask_2 = List.FilterByBoolMask(list=filterByBoolMask.in, mask=convertto_true_false_list)

# group: Create boundaries
flatten = Flatten(filterByBoolMask_2.in)
solids = Element.Solids(flatten)
faces = Topology.Faces(solids)
surfaceGeometry = Face.SurfaceGeometry(faces)
code_block_4 = CodeBlock { 1; }
flatten_2 = List.Flatten(list=surfaceGeometry, amt=code_block_4)
code_block_5 = CodeBlock { 0.5; }
pointAtParameter = Surface.PointAtParameter(surface=flatten_2, u=code_block_5, v=code_block_5)
Z = Point.Z(pointAtParameter)
sortByKey = List.SortByKey(list=flatten_2, keys=Z, lacing=Longest)
firstItem = List.FirstItem(sortByKey.sorted_list@L2)
perimeterCurves = Surface.PerimeterCurves(firstItem)

XY = Plane.XY()
code_block_6 = CodeBlock { 192910.000; 0; }
offset = Plane.Offset(XY, code_block_6.out0)
intersect = Geometry.Intersect(geometry=solids, other=offset)
byCoordinates = Point.ByCoordinates(x=code_block_6.out1, y=code_block_6.out1, z=code_block_6.out0)
ZAxis = Vector.ZAxis()
byOriginNormal = Plane.ByOriginNormal(origin=byCoordinates, normal=ZAxis)
doesIntersect = Geometry.DoesIntersect(geometry=solids, other=byOriginNormal)  # frozen
code_block_7 = CodeBlock { 194129.000; 2; 0; }
byCoordinates_2 = Point.ByCoordinates(x=code_block_7.out2, y=code_block_7.out1, z=code_block_7.out0)
byThreePoints = Plane.ByThreePoints(byCoordinates, arg2=byCoordinates_2)  # unwired: arg1
byCoordinates_3 = Point.ByCoordinates(x=code_block_7.out1, y=code_block_7.out2, z=code_block_7.out0)

# group: Input
enter_view_s_name = StringInput("A03.04_GENERAL ARRANGEMENT PLAN - L00")

# group: FILTER VIEWS
code_block_8 = CodeBlock { "OST_Views"; }
byName_2 = Category.ByName(code_block_8)
all_elements_of_category_2 = ElementsOfCategory(byName_2)
string_from_object = FromObject(all_elements_of_category_2)
code_block_9 = CodeBlock { true; }
contains = String.Contains(str=string_from_object, searchFor=enter_view_s_name, ignoreCase=code_block_9)
filterByBoolMask_3 = List.FilterByBoolMask(list=all_elements_of_category_2, mask=contains)
firstItem_2 = List.FirstItem(filterByBoolMask_3.in)

code_block_10 = CodeBlock { "TS_CONCRETE SETOUT"; }
byName_3 = FilledRegionType.ByName(code_block_10)
byCurves = FilledRegion.ByCurves(firstItem_2, perimeterCurves, byName_3)

# group: Filter out non created hatches
python_script = Python(IN[0]=byCurves)
# ---------- python_script.python (16 lines) ----------
import clr
clr.AddReference('ProtoGeometry')
from Autodesk.DesignScript.Geometry import *
#The inputs to this node will be stored as a list in the IN variables.
dataEnteringNode = IN

resultList = list()

for e in dataEnteringNode[0]:
	if e == None:
		resultList.append(False)
	else:
		resultList.append(True)

#Assign your output to the OUT variable.
OUT = resultList
# ----------------------------------------
filterByBoolMask_4 = List.FilterByBoolMask(list=byCurves, mask=python_script)

# group: Change hatches outlines to invisible
get_all_line_styles = Python()
# ---------- get_all_line_styles.python (24 lines) ----------
import clr
# import Document Manager
clr.AddReference("RevitServices")
import RevitServices 
from RevitServices.Persistence import DocumentManager
from RevitServices.Transactions import TransactionManager
doc = DocumentManager.Instance.CurrentDBDocument
uidoc = DocumentManager.Instance.CurrentUIDocument
clr.AddReference("RevitNodes")
import Revit
clr.ImportExtensions(Revit.Elements)
clr.ImportExtensions(Revit.GeometryConversion)
clr.AddReference("RevitAPI")
from Autodesk.Revit.DB import *


coll = FilteredElementCollector(doc).OfClass(GraphicsStyle).ToElementIds()

elements = []

for c in coll:
	elements.append(doc.GetElement(c))

OUT = elements
# ----------------------------------------
name = Element.Name(get_all_line_styles)
code_block_11 = CodeBlock { "<Invisible lines>"; }
firstIndexOf = List.FirstIndexOf(list=name, item=code_block_11)
getItemAtIndex = List.GetItemAtIndex(list=get_all_line_styles, index=firstIndexOf)
python_script_2 = Python(IN[0]=filterByBoolMask_4.in, IN[1]=getItemAtIndex)
# ---------- python_script_2.python (33 lines) ----------
import clr
clr.AddReference('ProtoGeometry')
from Autodesk.DesignScript.Geometry import *

# Import DocumentManager and TransactionManager
clr.AddReference("RevitServices")
import RevitServices
from RevitServices.Persistence import DocumentManager
from RevitServices.Transactions import TransactionManager

# Import RevitAPI
clr.AddReference("RevitAPI")
import Autodesk
from Autodesk.Revit.DB import *

doc = DocumentManager.Instance.CurrentDBDocument
uiapp = DocumentManager.Instance.CurrentUIApplication
app = uiapp.Application


region = UnwrapElement(IN[0])

ids = UnwrapElement(IN[1])

TransactionManager.Instance.EnsureInTransaction(doc)

for r in region:
	FilledRegion.SetLineStyleId(r, ids.Id)

TransactionManager.Instance.TransactionTaskDone()

#Assign your outputs to the OUT variable
OUT = region
# ----------------------------------------

code_block_12 = CodeBlock { "Concrete Setout Hatches"; }
fromElements = Custom[Group.FromElements](elements=python_script_2, groupName=code_block_12)  # Creates a group from a list of Revit elements
