# Dynamo graph Change-Grids-Name.dyn (Dynamo 1.3.2.2480)

# group: input
code_block = CodeBlock { "OST_Grids"; }
byName = Category.ByName(code_block)
# note: Rhythm
isolated_pick_model_elements = Custom[Isolated Pick Model Elements](Category=byName)  # This allows a multiple selection of elements of specified category.

# group: reverse order?
invertir_orden = BoolSelector(false)
reverse = List.Reverse(isolated_pick_model_elements)
if_ = CodeBlock(x=invertir_orden, y=reverse, z=isolated_pick_model_elements) { oldif(x,y,z); }
code_block_2 = CodeBlock()
# ---------- code_block_2.designscript (15 lines) ----------
def oldif(test, iftrue:var[]..[],
iffalse:var[]..[])
{
return = [Imperative]
{
if (test)
{
return = iftrue;
}
else
{
return = iffalse;
}
}
};
# ----------------------------------------

separador = StringInput("")

# group: number or string as new name
número_o_letra_de_inicio_de = StringInput("")  # "Número o letra de inicio de orden de rejillas"
toNumber = String.ToNumber(número_o_letra_de_inicio_de)
type = Object.Type(toNumber)
code_block_3 = CodeBlock { null; }
eq = type == code_block_3
nuevo_nombre_de_rejillas = StringInput("")
count = Count(if_)
code_block_4 = CodeBlock(a=número_o_letra_de_inicio_de, d=count) { a..#d..1; }
code_block_5 = CodeBlock(a=nuevo_nombre_de_rejillas, b=separador, c=code_block_4) { a+b+c; }
count_2 = Count(if_)
code_block_6 = CodeBlock(a=toNumber, d=count_2) { a..#d..1; }
code_block_7 = CodeBlock(a=nuevo_nombre_de_rejillas, b=separador, c=code_block_6) { a+b+c; }
if_2 = CodeBlock(x=eq, y=code_block_5, z=code_block_7) { oldif(x,y,z); }

# group: set new parameters
code_block_8 = CodeBlock { "Nombre"; }
setParameterByName = Element.SetParameterByName(element=if_, parameterName=code_block_8, value=if_2)
