# Dynamo graph DUPLICATE SHEET WITH VIEWS.dyn (Dynamo 1.2.1.3083)

# group: USER INTERFACE
# note: INPUT + CONTROL

# group: DESIGN
# note: BACK-END FUNCTIONALITY

# group: Duplicate sheet with views
# note: CREATED BY:
# CREATED: 2018.08.15
# VERSION: 1.0
# LAST EDITED: 2018.08.15
# DYNAMO VERSION: Dynamo 1.2.0
# PACKAGES:
# bimorphnodes
# NOTES:
# It can be tricky to make Sheet.Duplicate node to work depending on Dynamo and bimorph nodes' version. In case it stops to work, an alternative is Duplicate Sheets Pro:
# https://apps.autodesk.com/RVT/en/Detail/Index?id=7912232729068848638&appLang=en&os=Win64

# group: INSTRUCTIONS
# note: INSTRUCTIONS:
# 1. Fill in the required fields: Sheet Number, Option for duplicated views and the Prefix (Revit doesn't allow same named views).
# 2. Click on Run
# 3. Done, don't save the script when you close it.

# group: WIP
# note: USE:
# FOR UNFINISHED OR UNTESTED
# NODE BLOCKS
# note: WIP

# group: COMMENTS
# note: USE:
# FOR ANY COMMENTS OR PROJECT INFO
# note: COMMENTS

# group: TO REVIT
# note: USE:
# FOR ANY NODE THAT
# EXPORTS DATA TO REVIT
# note: TO REVIT

# group: INPUT
# note: USE:
# FOR FIXED INPUTS, LIKE FILE PATHS OR FIXED NUMBERS OR ELEMENTS THAT NEEDS TO BE
# TYPED BY THE FINAL USER
# note: INPUT

# group: CONTROL
# note: FIXED INPUTS THAT DICTATE WHAT
# THE SCRIPT IS USEFUL FOR
# note: CONTROL

# group: DESIGN
# note: USE:
# FOR GENERAL DEFINITIONS OF NODE BLOCKS
# note: DESIGN

# group: SELECT ALL SHEETS
code_block = CodeBlock { "OST_Sheets"; }
byName = Category.ByName(code_block)
all_elements_of_category = ElementsOfCategory(byName)

# group: ENTER SHEET NUMBER, OPTION AND PREFIX
sheet_number = StringInput("TP4.01")
enter_1_2_or_3 = StringInput("2")
# note: Options:
# 1 - Duplicate
# 2 - With Detailing
# 3 - Dependant
# note: ENTER SHEET NUMBER, PREFERRED OPTION TO DUPLICATE THE VIEWS ON THE SHEET AND A PREFIX TO ADD TO ALL VIEWS
prefix_to_add_to_sheet_and_all = StringInput("_")  # "Prefix to Add to Sheet and All Views"

# group: FILTER THE SHEET TO DUPLICATE
sheetNumber = Sheet.SheetNumber(all_elements_of_category)
contains = String.Contains(str=sheetNumber, searchFor=sheet_number)
filterByBoolMask = List.FilterByBoolMask(list=all_elements_of_category, mask=contains)

# group: DUPLICATE SHEETS
code_block_2 = CodeBlock { true; }
toNumber = String.ToNumber(enter_1_2_or_3)
# note: bimorph
duplicate = Revit.Sheet.Duplicate(filterByBoolMask.in, code_block_2, code_block_2, toNumber, arg5=prefix_to_add_to_sheet_and_all)
