# Dynamo graph DUPLICATE SHEETS.dyn (Dynamo 1.3.2.2480)

# group: input
# note: Instrucciones:
# 1. Descargar nodo SteamNode, Archi-lab, Springs y Clockwork de Paquetes>Buscar un paquete
# 2. Crear un plano en Revit para usarlo de referencia. Poner en ella sólo una vista que servirá de referencia para colocar los nuevas vistas en los planos.
# 3. Preparar la vista con una caja de referencia asignada en Propiedades>Extensión>Caja de referencia. Para crear dicha caja de de referencia; Vista>Crear>Caja de referencia
# 4. Seleccionar Cuadro de rotulación, Tipo de vista a usar, Plano de referencia a usar, escribir alguna/s palabra/s clave para el filtrado de vistas, el nombre de los planos al que automáticamente se les numerará consecutivamente y número de plano inicial.
plano_a_copiar = Sheets()
code_block = CodeBlock { "Nombre de plano"; }
getParameterValueByName = Element.GetParameterValueByName(element=plano_a_copiar, parameterName=code_block)
code_block_2 = CodeBlock(a=getParameterValueByName) { a + " COPIA"; }
número_de_plano = StringInput("101")
cuadro_de_rotulación = FamilyTypes()

# group: views from sheet
# note: Springs node
views = Custom[Springs.Sheet.Views+](sheet=plano_a_copiar)  # Extracts all views and schedules (minus the revision schedule) placed on the input sheet (or sheets). Will be depreciated once the bult in node works with all plan types.
# note: Clockwork node
type = Custom[View.Type](view=views.view_s)  # Returns the type of a given view
no_tocar = ViewTypesUi("Legend")
ne = type != no_tocar
filterByBoolMask = List.FilterByBoolMask(list=views.view_s, mask=ne)
duplicate = Custom[View.Duplicate](view=filterByBoolMask.in)  # Duplicates a given view
create = List.Create(duplicate)

# group: legend from sheet and location point
flatten = Flatten(filterByBoolMask.out)
firstItem = List.FirstItem(flatten)
getViewportsAndViews = RevitElements.Sheet.GetViewportsAndViews(plano_a_copiar)
filterByBoolMask_2 = List.FilterByBoolMask(list=getViewportsAndViews.out0, mask=ne)
# note: SteamNodes node
viewPortBoxCenter = Custom[View.ViewPortBoxCenter](Viewports=filterByBoolMask_2.out)  # Get ViewPort Box center point
firstItem_2 = List.FirstItem(viewPortBoxCenter)

# group: place views on sheets
byNameNumberTitleBlockAndViews = Sheet.ByNameNumberTitleBlockAndViews(code_block_2, número_de_plano, cuadro_de_rotulación, create, lacing=Longest)

# group: wait for the sheet to be created and pass it after
# note: Clockwork node
passthrough = Custom[Passthrough](passThrough=byNameNumberTitleBlockAndViews, waitFor=byNameNumberTitleBlockAndViews)  # Forces a sequential order of execution. The node wired into the output of the Passthrough node will be executed *after* the node wired into the waitFor input (e.g. important for some Revit operations). The value of the passThrough input will be passed on to the node wired into the output port of the Passthrough node.
code_block_3 = CodeBlock { null; }
create_2 = List.Create(passthrough, code_block_3)
flatten_2 = Flatten(create_2)

# group: units conversion, ViewPortBoxCenter may use meters
X = Point.X(firstItem_2)
code_block_4 = CodeBlock(a=X) { a*3.28; }
Y = Point.Y(firstItem_2)
code_block_5 = CodeBlock(a=Y) { a*3.28; 0; }
byCoordinates = Point.ByCoordinates(x=code_block_4, y=code_block_5.out0, z=code_block_5.out1)

# group: place legend on sheet
code_block_6 = CodeBlock(leyend=firstItem, sheet=passthrough, coordinates=byCoordinates) { leyend; sheet; coordinates; }
place_legend_on_sheets_py = Python(IN[0]=code_block_6.leyend, IN[1]=code_block_6.sheet, IN[2]=code_block_6.coordinates)
# ---------- place_legend_on_sheets_py.python (40 lines) ----------
import clr
# import Document Manager
clr.AddReference("RevitServices")
import RevitServices 
from RevitServices.Persistence import DocumentManager
from RevitServices.Transactions import TransactionManager
doc = DocumentManager.Instance.CurrentDBDocument
uidoc = DocumentManager.Instance.CurrentUIDocument
clr.AddReference("RevitNodes")
import Revit
clr.ImportExtensions(Revit.Elements)
clr.ImportExtensions(Revit.GeometryConversion)
clr.AddReference("RevitAPI")
from Autodesk.Revit.DB import *

dataEnteringNode = IN

legend = UnwrapElement(IN[0])
sheets = IN[1]
loc = XYZ(IN[2].X, IN[2].Y, IN[2].Z)
viewports = []
failed = []

for vs in sheets:
	sheet = UnwrapElement(vs)
	canAddToSht = Viewport.CanAddViewToSheet(doc, sheet.Id, legend.Id)
	if canAddToSht:
		try:		
			TransactionManager.Instance.EnsureInTransaction(doc)	
			viewport = Viewport.Create(doc, sheet.Id, legend.Id, loc)	
			TransactionManager.Instance.TransactionTaskDone()
			viewports.Add([viewport,sheet])
		except:
			failed.Add(["Failed",sheet])
	else:
		failed.Add(["Failed",sheet])
		
OUT = [viewports, failed]
	
#For more information refer to RBG Wiki or email me (ctrl + click link): daniel.woodcock@robertbird.com
# ----------------------------------------
succeded = CodeBlock(a=place_legend_on_sheets_py) { a[0]; }
failed = CodeBlock(a=place_legend_on_sheets_py) { a[1]; }

# group: schedule from sheet
watch = Watch(views.schedule_s)
firstItem_3 = List.FirstItem(watch)

# group: schedule from sheet
watch_2 = Watch(views.schedule_s)
code_block_7 = CodeBlock { 1; }
getItemAtIndex = List.GetItemAtIndex(list=watch_2, index=code_block_7)

# group: schedule from sheet
watch_3 = Watch(views.schedule_s)
code_block_8 = CodeBlock { 2; }
getItemAtIndex_2 = List.GetItemAtIndex(list=watch_3, index=code_block_8)

# group: place schedules on sheet
place_schedules_on_sheet = Python(IN[0]=firstItem_3, IN[1]=flatten_2)
# ---------- place_schedules_on_sheet.python (32 lines) ----------
import clr

# Import DocumentManager
clr.AddReference('RevitServices')
import RevitServices
from RevitServices.Persistence import DocumentManager
from RevitServices.Transactions import TransactionManager

doc = DocumentManager.Instance.CurrentDBDocument

# Import RevitNodes/Import ToDSType(bool) extension method
clr.AddReference("RevitNodes")
import Revit
clr.ImportExtensions(Revit.Elements)

# Import RevitAPI
clr.AddReference('RevitAPI')
from Autodesk.Revit.DB import ScheduleSheetInstance

schedule1 = UnwrapElement(IN[0])
sheets = UnwrapElement(IN[1])
schedule_id = schedule1.ScheduleId
schedule_pt = schedule1.Point
schedules = []

TransactionManager.Instance.EnsureInTransaction(doc)
for sheet in sheets:
	ns1 = ScheduleSheetInstance.Create(doc, sheet.Id, schedule_id, schedule_pt)
	schedules.append(ns1.ToDSType(False))
TransactionManager.Instance.TransactionTaskDone()

OUT = schedules
# ----------------------------------------
place_schedules_on_sheet_2 = Python(IN[0]=getItemAtIndex, IN[1]=flatten_2)  # same code as place_schedules_on_sheet
place_schedules_on_sheet_3 = Python(IN[0]=getItemAtIndex_2, IN[1]=flatten_2)  # same code as place_schedules_on_sheet

# group: set viewport title
code_block_9 = CodeBlock { "Tipo"; }
getViewportsAndViews_2 = RevitElements.Sheet.GetViewportsAndViews(byNameNumberTitleBlockAndViews)
flatten_3 = Flatten(getViewportsAndViews_2)
code_block_10 = CodeBlock { "Familia y tipo"; }
getViewportsAndViews_3 = RevitElements.Sheet.GetViewportsAndViews(plano_a_copiar)
type_2 = Custom[View.Type](view=getViewportsAndViews_3.out1)
no_tocar_2 = ViewTypesUi("Legend")
ne_2 = type_2 != no_tocar_2
filterByBoolMask_3 = List.FilterByBoolMask(list=getViewportsAndViews_3.out0, mask=ne_2)
getParameterValueByName_2 = Element.GetParameterValueByName(element=filterByBoolMask_3.in, parameterName=code_block_10)
setParameterByName = Element.SetParameterByName(element=flatten_3, parameterName=code_block_10, value=getParameterValueByName_2)

type_3 = Custom[View.Type](view=getViewportsAndViews.out1)
ne_3 = type_3 != no_tocar
filterByBoolMask_4 = List.FilterByBoolMask(list=getViewportsAndViews.out0, mask=ne_3)

# group: Get viewports from template sheet, get center points from viewport
getViewport = Custom[View.GetViewport](Sheet=plano_a_copiar)  # Get Vieworts from Views
code_block_11 = CodeBlock(a=getViewport) { Flatten({a}); }
viewPortBoxCenter_2 = Custom[View.ViewPortBoxCenter](Viewports=filterByBoolMask_4.in)

# group: Set viewport center
getViewport_2 = Custom[View.GetViewport](Sheet=byNameNumberTitleBlockAndViews)
setBoxCenter = Custom[Viewport.SetBoxCenter](Points=viewPortBoxCenter_2)  # API class; unwired: Viewport_list
map = List.Map(list=getViewport_2, f_x=setBoxCenter)

filterByBoolMask_5 = List.FilterByBoolMask(list=getViewportsAndViews.out1, mask=ne_3)
getView = RevitElements.Viewport.GetView(filterByBoolMask_4.in)
get_all_viewport_types = Custom[Get All Viewport Types]()  # This node will retrieve all Viewport Types currently in the model.
firstItem_4 = List.FirstItem(get_all_viewport_types)
lastItem = List.LastItem(get_all_viewport_types)
getViewport_3 = Custom[View.GetViewport]()  # unwired: Sheet
sortListByAnother = archilab.Lists.Lists.SortListByAnother(getViewportsAndViews.out1)  # unwired: arg1
