# Dynamo graph FLOOR FROM ROOMS.dyn (Dynamo 1.2.1.3083)

# group: USER INTERFACE
# note: INPUT + CONTROL

# group: DESIGN
# note: BACK-END FUNCTIONALITY

# group: CREATE FLOOR FINISHES FROM ROOMS FLOOR FINISH
# note: CREATED BY:
# CREATED: 2018.08.15
# VERSION: 1.0
# LAST EDITED: 2018.08.15
# DYNAMO VERSION: Dynamo 1.2.0
# PACKAGES:
# None
# NOTES:
# <NOTES>

# group: INSTRUCTIONS
# note: INSTRUCTIONS:
# 1. Select level to place the Floors.
# 2. Enter offset from that level.
# 3. Click Run.

# group: WIP
# note: USE:
# FOR UNFINISHED OR UNTESTED
# NODE BLOCKS
# note: WIP

# group: COMMENTS
# note: USE:
# FOR ANY COMMENTS OR PROJECT INFO
# note: COMMENTS

# group: TO REVIT
# note: USE:
# FOR ANY NODE THAT
# EXPORTS DATA TO REVIT
# note: TO REVIT

# group: INPUT
# note: USE:
# FOR FIXED INPUTS, LIKE FILE PATHS OR FIXED NUMBERS OR ELEMENTS THAT NEEDS TO BE
# TYPED BY THE FINAL USER
# note: INPUT

# group: CONTROL
# note: FIXED INPUTS THAT DICTATE WHAT
# THE SCRIPT IS USEFUL FOR
# note: CONTROL

# group: DESIGN
# note: USE:
# FOR GENERAL DEFINITIONS OF NODE BLOCKS
# note: DESIGN

# group: SELECT ALL ROOMS
code_block = CodeBlock { "OST_Rooms"; }
byName = Category.ByName(code_block)
all_elements_of_category = ElementsOfCategory(byName)

# group: FILTER NO PLACED ROOMS AND MATCH ITS FINISHED FLOORS
code_block_2 = CodeBlock { "Area"; }
getParameterValueByName = Element.GetParameterValueByName(element=all_elements_of_category, parameterName=code_block_2)
code_block_3 = CodeBlock { "Floor Finish"; }
getParameterValueByName_2 = Element.GetParameterValueByName(element=all_elements_of_category, parameterName=code_block_3)
python_script = Python(IN[0]=getParameterValueByName, IN[1]=getParameterValueByName_2)
# ---------- python_script.python (20 lines) ----------
import clr
clr.AddReference('ProtoGeometry')
from Autodesk.DesignScript.Geometry import *
#The inputs to this node will be stored as a list in the IN variables.
dataEnteringNode = IN
data2 = IN[1]

finalList = []
i = -1


for element in dataEnteringNode[0]:
	if element != "":
		i = i + 1
		finalList.append(data2[i])
	else:
		i = i + 1
			
#Assign your output to the OUT variable.
OUT = finalList
# ----------------------------------------
code_block_4 = CodeBlock { ""; }
ne = getParameterValueByName != code_block_4
filterByBoolMask = List.FilterByBoolMask(list=all_elements_of_category, mask=ne)

code_block_5 = CodeBlock { "Floor Finish"; }
getParameterValueByName_3 = Element.GetParameterValueByName(element=filterByBoolMask.in, parameterName=code_block_5)
code_block_6 = CodeBlock { ""; }
ne_2 = getParameterValueByName_3 != code_block_6
filterByBoolMask_2 = List.FilterByBoolMask(list=filterByBoolMask.in, mask=ne_2)
flatten = Flatten(filterByBoolMask_2.in)
faces = Element.Faces(filterByBoolMask_2.in)
code_block_7 = CodeBlock { 0.5; }
pointAtParameter = Surface.PointAtParameter(surface=faces, u=code_block_7, v=code_block_7)
Z = Point.Z(pointAtParameter)
sortByKey = List.SortByKey(list=faces, keys=Z, lacing=Longest)
firstItem = List.FirstItem(sortByKey.sorted_list@L2)
perimeterCurves = Surface.PerimeterCurves(firstItem)
code_block_8 = CodeBlock { "Floor Finish"; }
getParameterValueByName_4 = Element.GetParameterValueByName(element=filterByBoolMask_2.in, parameterName=code_block_8)

# group (continued): FILTER NO PLACED ROOMS AND MATCH ITS FINISHED FLOORS
byName_2 = FloorType.ByName(getParameterValueByName_4)

# group: LEVEL AND OFFSET OF THE FINISHES
# note: LEVEL TO PLACE THE FLOOR FINISHES AND DESIRED OFFSET FROM THE LEVEL
levels = Levels("L00")
offset_from_level = DoubleInput(0)

# group: CREATE FINISH FLOORS AND ADJUST POSITION
byOutlineTypeAndLevel = Floor.ByOutlineTypeAndLevel(outlineCurves=perimeterCurves, floorType=byName_2, level=levels)
code_block_9 = CodeBlock { "Height Offset From Level"; }
setParameterByName = Element.SetParameterByName(element=byOutlineTypeAndLevel, parameterName=code_block_9, value=offset_from_level)

# group: GROUP FLOOR ELEMENTS
code_block_10 = CodeBlock { "Floor Finish DO NOT MAKE CHANGES INSIDE"; }
fromElements = Custom[Group.FromElements](elements=setParameterByName, groupName=code_block_10)  # Creates a group from a list of Revit elements
