# Dynamo graph FURNITURE SCHEDULE BY ROOM.dyn (Dynamo 1.2.1.3083)

# group: USER INTERFACE
# note: INPUT + CONTROL

# group: DESIGN
# note: BACK-END FUNCTIONALITY

# group: Furniture Schedule By Room
# note: CREATED BY:
# CREATED: 2018.10.05
# VERSION: 1.0
# LAST EDITED: 2018.10.05
# DYNAMO VERSION: Dynamo 1.2.0
# PACKAGES:
# None
# NOTES:
# <NOTES>

# group: INSTRUCTIONS
# note: INSTRUCTIONS:
# <INSTRUCTIONS>

# group: WIP
# note: USE:
# FOR UNFINISHED OR UNTESTED
# NODE BLOCKS
# note: WIP

# group: COMMENTS
# note: USE:
# FOR ANY COMMENTS OR PROJECT INFO
# note: COMMENTS

# group: TO REVIT
# note: USE:
# FOR ANY NODE THAT
# EXPORTS DATA TO REVIT
# note: TO REVIT

# group: INPUT
# note: USE:
# FOR FIXED INPUTS, LIKE FILE PATHS OR FIXED NUMBERS OR ELEMENTS THAT NEEDS TO BE
# TYPED BY THE FINAL USER
# note: INPUT

# group: CONTROL
# note: FIXED INPUTS THAT DICTATE WHAT
# THE SCRIPT IS USEFUL FOR
# note: CONTROL

# group: DESIGN
# note: USE:
# FOR GENERAL DEFINITIONS OF NODE BLOCKS
# note: DESIGN

# group: SELECT ALL FURNITURE
code_block = CodeBlock { "OST_Furniture"; }
byName = Category.ByName(code_block)
all_elements_of_category = ElementsOfCategory(byName)

# group: GET THE ROOM IN WHICH ELEMENTS ARE
room = Custom[Element.Room](element=all_elements_of_category)  # This node takes the input of all elements of category and reports back the associated room per element. Currently tested with casework, furniture and plumbing fixtures.
code_block_2 = CodeBlock { "Number"; }
getParameterValueByName = Element.GetParameterValueByName(element=room, parameterName=code_block_2)

# group: WRITE PARAMETERS TO REVIT
code_block_3 = CodeBlock { "Room"; }
setParameterByName = Element.SetParameterByName(element=all_elements_of_category, parameterName=code_block_3, value=getParameterValueByName)
