# Dynamo graph Floor Finish From Rooms .dyn "Floor Finish From Rooms" (Dynamo 2.0.2.6826)

# group: CREATE FLOOR FINISHES FROM ROOMS FLOOR FINISH
# note: CREATED BY:
# CREATED: 2018.08.15
# VERSION: 2.0
# LAST EDITED: 2019.01.15
# DYNAMO VERSION: Dynamo 2.0
# PACKAGES:
# Clockwork
# NOTES:
# Rooms that don´t have Floor Finish assigned or 'islands' inside will be excluded.

# group: INSTRUCTIONS
# note: INSTRUCTIONS:
# 1. Select level to place the Floors.
# 2. Enter offset from that level.
# 3. Click Run.

# group: DESIGN
# note: BACK-END FUNCTIONALITY

# group: USER INTERFACE
# note: INPUT + CONTROL

# group: WIP
# note: USE:
# FOR UNFINISHED OR UNTESTED
# BLOCKS OF CODE
# note: WIP

# group: COMMENTS
# note: USE:
# FOR ANY COMMENTS OR PROJECT INFO
# note: COMMENTS

# group: TO REVIT
# note: USE:
# FOR ANY GROUP THAT
# WRITES DATA TO REVIT
# note: TO REVIT

# group: DESIGN
# note: USE:
# FOR GENERAL DEFINITIONS OF NODE BLOCKS
# note: DESIGN

# group: INPUT
# note: USE:
# INPUTS THAT ARE REQUIRED TO BE
# DECLARED BY THE USER
# note: INPUT

# group: SELECT ALL ROOMS
code_block = CodeBlock { "OST_Rooms"; }
byName = Category.ByName(name=code_block)
all_elements_of_category = ElementsOfCategory(Category=byName)

# group: FILTER NON PLACED ROOMS
code_block_2 = CodeBlock { "Area"; }
getParameterValueByName = Element.GetParameterValueByName(element=all_elements_of_category, parameterName=code_block_2)
code_block_3 = CodeBlock { ""; }
ne = getParameterValueByName != code_block_3
filterByBoolMask = List.FilterByBoolMask(list=all_elements_of_category, mask=ne)

# group: FILTER ROOMS WITHOUT A FLOOR FINISH ASSIGNED
code_block_4 = CodeBlock { "Floor Finish"; }
getParameterValueByName_2 = Element.GetParameterValueByName(element=filterByBoolMask.in, parameterName=code_block_4)
code_block_5 = CodeBlock { ""; }
ne_2 = getParameterValueByName_2 != code_block_5
filterByBoolMask_2 = List.FilterByBoolMask(list=filterByBoolMask.in, mask=ne_2)

# group: LEVEL AND OFFSET OF THE FLOOR FINISHES
# note: LEVEL TO PLACE THE FLOOR FINISHES AND OFFSET FROM THE LEVEL
level_to_place_floor_finish = Levels(index=0)  # graph input
offset_from_level = DoubleInput(0)  # graph input

# group: FILTER ROOMS BY LEVEL
code_block_6 = CodeBlock { "Level"; }
getParameterValueByName_3 = Element.GetParameterValueByName(element=filterByBoolMask_2.in, parameterName=code_block_6)
name = Level.Name(level=level_to_place_floor_finish)
eq = getParameterValueByName_3 == name
filterByBoolMask_3 = List.FilterByBoolMask(list=filterByBoolMask_2.in, mask=eq)

# group: GET ROOMS BOUNDARIES
faces = Element.Faces(element=filterByBoolMask_3.in)
code_block_7 = CodeBlock { 0.5; }
pointAtParameter = Surface.PointAtParameter(surface=faces, u=code_block_7, v=code_block_7)
Z = Point.Z(point=pointAtParameter)
sortByKey = List.SortByKey(list=faces, keys=Z, lacing=Longest)
firstItem = List.FirstItem(list=sortByKey.sorted_list@L2)
perimeterCurves = Surface.PerimeterCurves(surface=firstItem)

# group: GET FLOOR TYPE FROM THE MODEL
code_block_8 = CodeBlock { "Floor Finish"; }
getParameterValueByName_4 = Element.GetParameterValueByName(element=filterByBoolMask_3.in, parameterName=code_block_8)
byName_2 = FloorType.ByName(name=getParameterValueByName_4)

# group: CREATE FINISH FLOORS AND ADJUST POSITION
byOutlineTypeAndLevel = Floor.ByOutlineTypeAndLevel(outlineCurves=perimeterCurves, floorType=byName_2, level=level_to_place_floor_finish)
code_block_9 = CodeBlock { "Height Offset From Level"; }
setParameterByName = Element.SetParameterByName(element=byOutlineTypeAndLevel, parameterName=code_block_9, value=offset_from_level)

# group: GROUP FLOOR ELEMENTS
code_block_10 = CodeBlock { "FLOOR FINISHES"; }
# note: Clockwork
fromElements = Custom[Group.FromElements](elements=setParameterByName, groupName=code_block_10)  # Creates a group from a list of Revit elements
