# Dynamo graph GROUP SHEETS IN SERIES.dyn (Dynamo 1.2.1.3083)

# group: USER INTERFACE
# note: INPUT + CONTROL

# group: DESIGN
# note: BACK-END FUNCTIONALITY

# group: DIVIDE DRAWING REGISTER INTO SECTIONS
# note: CREATED BY:
# CREATED: 2018.08.15
# VERSION: 1.0
# LAST EDITED: 2018.08.15
# DYNAMO VERSION: Dynamo 1.2.0
# PACKAGES:
# None
# NOTES:
# <NOTES>

# group: INSTRUCTIONS
# note: INSTRUCTIONS:
# <INSTRUCTIONS>

# group: WIP
# note: USE:
# FOR UNFINISHED OR UNTESTED
# NODE BLOCKS
# note: WIP

# group: COMMENTS
# note: USE:
# FOR ANY COMMENTS OR PROJECT INFO
# note: COMMENTS

# group: TO REVIT
# note: USE:
# FOR ANY NODE THAT
# EXPORTS DATA TO REVIT
# note: TO REVIT

# group: INPUT
# note: USE:
# FOR FIXED INPUTS, LIKE FILE PATHS OR FIXED NUMBERS OR ELEMENTS THAT NEEDS TO BE
# TYPED BY THE FINAL USER
# note: INPUT

# group: CONTROL
# note: FIXED INPUTS THAT DICTATE WHAT
# THE SCRIPT IS USEFUL FOR
# note: CONTROL

# group: DESIGN
# note: USE:
# FOR GENERAL DEFINITIONS OF NODE BLOCKS
# note: DESIGN

# group: Select all sheets
code_block = CodeBlock { "OST_Sheets"; }
byName = Category.ByName(code_block)
all_elements_of_category = ElementsOfCategory(byName)

# group: GET SHEET NUMBER
sheetNumber = Sheet.SheetNumber(all_elements_of_category)

# group: SERIES TITLE
code_block_2 = CodeBlock()
# ---------- code_block_2.designscript (34 lines) ----------
"A00";
"A01";
"A02";
"A03";
"A04";
"A05";
"A06";
"A07";
"A08";
"A09";
"A10";
"A11";
"A12";
"A13";
"A14";
"A15";
"A16";
"A17";
"A18";
"A19";
"A20";
"A21";
"A22";
"A23";
"A24";
"A25";
"A26";
"A27";
"A28";
"A29";
"A30";
"A31";
"A32";
"A33";
# ----------------------------------------
code_block_3 = CodeBlock()
# ---------- code_block_3.designscript (34 lines) ----------
"COVER SHEET, NOTES AND LEGENDS";
"SITE PLANS, STAGING, DEMOLITION, HARD LANDSCAPE AND GRID SET OUT";
"KEY PLANS";
"GENERAL ARRANGEMENT PLANS";
"CONCRETE PROFILE PLANS";
"WALL TYPE & SET-OUT PLANS";
"REFLECTED CEILING PLANS";
"FINISHES PLAN";
"FLOOR FINISHES PLAN";
"FIT OUT PLANS";
"ELEVATIONS";
"SECTION REFERENCE PLAN & SECTIONS";
"CORE STAIR AND LIFT PLAN AND DETAILS";
"FAÇADE SET OUT PLANS AND ELEVATIONS/DETAILS";
"PLAN DETAILS";
"SECTION DETAILS";
"GENERAL CONSTRUCTION DETAILS";
"LANDSCAPE CONSTRUCTION DETAILS";
"SUITE DETAILS";
"WET AREA PLANS & ELEVATIONS";
"INTERNAL AREA PLANS & ELEVATIONS";
"INTERNAL DETAILS";
"JOINERY DETAILS";
"WINDOW AND DOOR SCHEDULES";
"EXTERIOR FINISHES SCHEDULE";
"INTERIOR FINISHES SCHEDULE";
"FURNITURE SCHEDULE";
"FIXTURE SCHEDULE";
"EQUIPMENT SCHEDULE";
"DECORATIVE LIGHTING SCHEDULE";
"PC-PS SCHEDULE";
"DOOR SCHEDULE";
"ARCHITECTURAL SPECIFICATION";
"FAÇADE SPECIFICATION";
# ----------------------------------------

# group: GET SHEETS IN SERIES
startsWith = String.StartsWith(str=sheetNumber, searchFor=code_block_2.out0)
filterByBoolMask = List.FilterByBoolMask(list=all_elements_of_category, mask=startsWith)

# group: WRITE PARAMETERS TO REVIT
set_sheet_series_parameters = Custom[Set Sheet Series Parameters](element=filterByBoolMask.in, Sheet_Series_Title_value=code_block_3.out0, Sheet_Series_value=code_block_2.out0)  # Set Sheet Series Series and Sheet Series Title

# group: GET SHEETS IN SERIES
startsWith_2 = String.StartsWith(str=sheetNumber, searchFor=code_block_2.out1)
filterByBoolMask_2 = List.FilterByBoolMask(list=all_elements_of_category, mask=startsWith_2)

# group: WRITE PARAMETERS TO REVIT
set_sheet_series_parameters_2 = Custom[Set Sheet Series Parameters](element=filterByBoolMask_2.in, Sheet_Series_Title_value=code_block_3.out1, Sheet_Series_value=code_block_2.out1)

# group: GET SHEETS IN SERIES
startsWith_3 = String.StartsWith(str=sheetNumber, searchFor=code_block_2.out2)
filterByBoolMask_3 = List.FilterByBoolMask(list=all_elements_of_category, mask=startsWith_3)

# group: WRITE PARAMETERS TO REVIT
set_sheet_series_parameters_3 = Custom[Set Sheet Series Parameters](element=filterByBoolMask_3.in, Sheet_Series_Title_value=code_block_3.out2, Sheet_Series_value=code_block_2.out2)

# group: GET SHEETS IN SERIES
startsWith_4 = String.StartsWith(str=sheetNumber, searchFor=code_block_2.out3)
filterByBoolMask_4 = List.FilterByBoolMask(list=all_elements_of_category, mask=startsWith_4)

# group: WRITE PARAMETERS TO REVIT
set_sheet_series_parameters_4 = Custom[Set Sheet Series Parameters](element=filterByBoolMask_4.in, Sheet_Series_Title_value=code_block_3.out3, Sheet_Series_value=code_block_2.out3)

# group: GET SHEETS IN SERIES
startsWith_5 = String.StartsWith(str=sheetNumber, searchFor=code_block_2.out4)
filterByBoolMask_5 = List.FilterByBoolMask(list=all_elements_of_category, mask=startsWith_5)

# group: WRITE PARAMETERS TO REVIT
set_sheet_series_parameters_5 = Custom[Set Sheet Series Parameters](element=filterByBoolMask_5.in, Sheet_Series_Title_value=code_block_3.out4, Sheet_Series_value=code_block_2.out4)

# group: GET SHEETS IN SERIES
startsWith_6 = String.StartsWith(str=sheetNumber, searchFor=code_block_2.out5)
filterByBoolMask_6 = List.FilterByBoolMask(list=all_elements_of_category, mask=startsWith_6)

# group: WRITE PARAMETERS TO REVIT
set_sheet_series_parameters_6 = Custom[Set Sheet Series Parameters](element=filterByBoolMask_6.in, Sheet_Series_Title_value=code_block_3.out5, Sheet_Series_value=code_block_2.out5)

# group: GET SHEETS IN SERIES
startsWith_7 = String.StartsWith(str=sheetNumber, searchFor=code_block_2.out6)
filterByBoolMask_7 = List.FilterByBoolMask(list=all_elements_of_category, mask=startsWith_7)

# group: WRITE PARAMETERS TO REVIT
set_sheet_series_parameters_7 = Custom[Set Sheet Series Parameters](element=filterByBoolMask_7.in, Sheet_Series_Title_value=code_block_3.out6, Sheet_Series_value=code_block_2.out6)

# group: GET SHEETS IN SERIES
startsWith_8 = String.StartsWith(str=sheetNumber, searchFor=code_block_2.out7)
filterByBoolMask_8 = List.FilterByBoolMask(list=all_elements_of_category, mask=startsWith_8)

# group: WRITE PARAMETERS TO REVIT
set_sheet_series_parameters_8 = Custom[Set Sheet Series Parameters](element=filterByBoolMask_8.in, Sheet_Series_Title_value=code_block_3.out7, Sheet_Series_value=code_block_2.out7)

# group: GET SHEETS IN SERIES
startsWith_9 = String.StartsWith(str=sheetNumber, searchFor=code_block_2.out8)
filterByBoolMask_9 = List.FilterByBoolMask(list=all_elements_of_category, mask=startsWith_9)

# group: WRITE PARAMETERS TO REVIT
set_sheet_series_parameters_9 = Custom[Set Sheet Series Parameters](element=filterByBoolMask_9.in, Sheet_Series_Title_value=code_block_3.out8, Sheet_Series_value=code_block_2.out8)

# group: GET SHEETS IN SERIES
startsWith_10 = String.StartsWith(str=sheetNumber, searchFor=code_block_2.out9)
filterByBoolMask_10 = List.FilterByBoolMask(list=all_elements_of_category, mask=startsWith_10)

# group: WRITE PARAMETERS TO REVIT
set_sheet_series_parameters_10 = Custom[Set Sheet Series Parameters](element=filterByBoolMask_10.in, Sheet_Series_Title_value=code_block_3.out9, Sheet_Series_value=code_block_2.out9)

# group: GET SHEETS IN SERIES
startsWith_11 = String.StartsWith(str=sheetNumber, searchFor=code_block_2.out10)
filterByBoolMask_11 = List.FilterByBoolMask(list=all_elements_of_category, mask=startsWith_11)

# group: WRITE PARAMETERS TO REVIT
set_sheet_series_parameters_11 = Custom[Set Sheet Series Parameters](element=filterByBoolMask_11.in, Sheet_Series_Title_value=code_block_3.out10, Sheet_Series_value=code_block_2.out10)

# group: GET SHEETS IN SERIES
startsWith_12 = String.StartsWith(str=sheetNumber, searchFor=code_block_2.out11)
filterByBoolMask_12 = List.FilterByBoolMask(list=all_elements_of_category, mask=startsWith_12)

# group: WRITE PARAMETERS TO REVIT
set_sheet_series_parameters_12 = Custom[Set Sheet Series Parameters](element=filterByBoolMask_12.in, Sheet_Series_Title_value=code_block_3.out11, Sheet_Series_value=code_block_2.out11)

# group: GET SHEETS IN SERIES
startsWith_13 = String.StartsWith(str=sheetNumber, searchFor=code_block_2.out12)
filterByBoolMask_13 = List.FilterByBoolMask(list=all_elements_of_category, mask=startsWith_13)

# group: WRITE PARAMETERS TO REVIT
set_sheet_series_parameters_13 = Custom[Set Sheet Series Parameters](element=filterByBoolMask_13.in, Sheet_Series_Title_value=code_block_3.out12, Sheet_Series_value=code_block_2.out12)

# group: GET SHEETS IN SERIES
startsWith_14 = String.StartsWith(str=sheetNumber, searchFor=code_block_2.out13)
filterByBoolMask_14 = List.FilterByBoolMask(list=all_elements_of_category, mask=startsWith_14)

# group: WRITE PARAMETERS TO REVIT
set_sheet_series_parameters_14 = Custom[Set Sheet Series Parameters](element=filterByBoolMask_14.in, Sheet_Series_Title_value=code_block_3.out13, Sheet_Series_value=code_block_2.out13)

# group: GET SHEETS IN SERIES
startsWith_15 = String.StartsWith(str=sheetNumber, searchFor=code_block_2.out14)
filterByBoolMask_15 = List.FilterByBoolMask(list=all_elements_of_category, mask=startsWith_15)

# group: WRITE PARAMETERS TO REVIT
set_sheet_series_parameters_15 = Custom[Set Sheet Series Parameters](element=filterByBoolMask_15.in, Sheet_Series_Title_value=code_block_3.out14, Sheet_Series_value=code_block_2.out14)

# group: GET SHEETS IN SERIES
startsWith_16 = String.StartsWith(str=sheetNumber, searchFor=code_block_2.out15)
filterByBoolMask_16 = List.FilterByBoolMask(list=all_elements_of_category, mask=startsWith_16)

# group: WRITE PARAMETERS TO REVIT
set_sheet_series_parameters_16 = Custom[Set Sheet Series Parameters](element=filterByBoolMask_16.in, Sheet_Series_Title_value=code_block_3.out15, Sheet_Series_value=code_block_2.out15)

# group: GET SHEETS IN SERIES
startsWith_17 = String.StartsWith(str=sheetNumber, searchFor=code_block_2.out16)
filterByBoolMask_17 = List.FilterByBoolMask(list=all_elements_of_category, mask=startsWith_17)

# group: WRITE PARAMETERS TO REVIT
set_sheet_series_parameters_17 = Custom[Set Sheet Series Parameters](element=filterByBoolMask_17.in, Sheet_Series_Title_value=code_block_3.out16, Sheet_Series_value=code_block_2.out16)

# group: GET SHEETS IN SERIES
startsWith_18 = String.StartsWith(str=sheetNumber, searchFor=code_block_2.out17)
filterByBoolMask_18 = List.FilterByBoolMask(list=all_elements_of_category, mask=startsWith_18)

# group: WRITE PARAMETERS TO REVIT
set_sheet_series_parameters_18 = Custom[Set Sheet Series Parameters](element=filterByBoolMask_18.in, Sheet_Series_Title_value=code_block_3.out17, Sheet_Series_value=code_block_2.out17)

# group: GET SHEETS IN SERIES
startsWith_19 = String.StartsWith(str=sheetNumber, searchFor=code_block_2.out18)
filterByBoolMask_19 = List.FilterByBoolMask(list=all_elements_of_category, mask=startsWith_19)

# group: WRITE PARAMETERS TO REVIT
set_sheet_series_parameters_19 = Custom[Set Sheet Series Parameters](element=filterByBoolMask_19.in, Sheet_Series_Title_value=code_block_3.out18, Sheet_Series_value=code_block_2.out18)

# group: GET SHEETS IN SERIES
startsWith_20 = String.StartsWith(str=sheetNumber, searchFor=code_block_2.out19)
filterByBoolMask_20 = List.FilterByBoolMask(list=all_elements_of_category, mask=startsWith_20)

# group: WRITE PARAMETERS TO REVIT
set_sheet_series_parameters_20 = Custom[Set Sheet Series Parameters](element=filterByBoolMask_20.in, Sheet_Series_Title_value=code_block_3.out19, Sheet_Series_value=code_block_2.out19)

# group: GET SHEETS IN SERIES
startsWith_21 = String.StartsWith(str=sheetNumber, searchFor=code_block_2.out20)
filterByBoolMask_21 = List.FilterByBoolMask(list=all_elements_of_category, mask=startsWith_21)

# group: WRITE PARAMETERS TO REVIT
set_sheet_series_parameters_21 = Custom[Set Sheet Series Parameters](element=filterByBoolMask_21.in, Sheet_Series_Title_value=code_block_3.out20, Sheet_Series_value=code_block_2.out20)

# group: GET SHEETS IN SERIES
startsWith_22 = String.StartsWith(str=sheetNumber, searchFor=code_block_2.out21)
filterByBoolMask_22 = List.FilterByBoolMask(list=all_elements_of_category, mask=startsWith_22)

# group: WRITE PARAMETERS TO REVIT
set_sheet_series_parameters_22 = Custom[Set Sheet Series Parameters](element=filterByBoolMask_22.in, Sheet_Series_Title_value=code_block_3.out21, Sheet_Series_value=code_block_2.out21)

# group: GET SHEETS IN SERIES
startsWith_23 = String.StartsWith(str=sheetNumber, searchFor=code_block_2.out22)
filterByBoolMask_23 = List.FilterByBoolMask(list=all_elements_of_category, mask=startsWith_23)

# group: WRITE PARAMETERS TO REVIT
set_sheet_series_parameters_23 = Custom[Set Sheet Series Parameters](element=filterByBoolMask_23.in, Sheet_Series_Title_value=code_block_3.out22, Sheet_Series_value=code_block_2.out22)

# group: GET SHEETS IN SERIES
startsWith_24 = String.StartsWith(str=sheetNumber, searchFor=code_block_2.out23)
filterByBoolMask_24 = List.FilterByBoolMask(list=all_elements_of_category, mask=startsWith_24)

# group: WRITE PARAMETERS TO REVIT
set_sheet_series_parameters_24 = Custom[Set Sheet Series Parameters](element=filterByBoolMask_24.in, Sheet_Series_Title_value=code_block_3.out23, Sheet_Series_value=code_block_2.out23)

# group: GET SHEETS IN SERIES
startsWith_25 = String.StartsWith(str=sheetNumber, searchFor=code_block_2.out24)
filterByBoolMask_25 = List.FilterByBoolMask(list=all_elements_of_category, mask=startsWith_25)

# group: WRITE PARAMETERS TO REVIT
set_sheet_series_parameters_25 = Custom[Set Sheet Series Parameters](element=filterByBoolMask_25.in, Sheet_Series_Title_value=code_block_3.out24, Sheet_Series_value=code_block_2.out24)

# group: GET SHEETS IN SERIES
startsWith_26 = String.StartsWith(str=sheetNumber, searchFor=code_block_2.out25)
filterByBoolMask_26 = List.FilterByBoolMask(list=all_elements_of_category, mask=startsWith_26)

# group: WRITE PARAMETERS TO REVIT
set_sheet_series_parameters_26 = Custom[Set Sheet Series Parameters](element=filterByBoolMask_26.in, Sheet_Series_Title_value=code_block_3.out25, Sheet_Series_value=code_block_2.out25)

# group: GET SHEETS IN SERIES
startsWith_27 = String.StartsWith(str=sheetNumber, searchFor=code_block_2.out26)
filterByBoolMask_27 = List.FilterByBoolMask(list=all_elements_of_category, mask=startsWith_27)

# group: WRITE PARAMETERS TO REVIT
set_sheet_series_parameters_27 = Custom[Set Sheet Series Parameters](element=filterByBoolMask_27.in, Sheet_Series_Title_value=code_block_3.out26, Sheet_Series_value=code_block_2.out26)

# group: GET SHEETS IN SERIES
startsWith_28 = String.StartsWith(str=sheetNumber, searchFor=code_block_2.out27)
filterByBoolMask_28 = List.FilterByBoolMask(list=all_elements_of_category, mask=startsWith_28)

# group: WRITE PARAMETERS TO REVIT
set_sheet_series_parameters_28 = Custom[Set Sheet Series Parameters](element=filterByBoolMask_28.in, Sheet_Series_Title_value=code_block_3.out27, Sheet_Series_value=code_block_2.out27)

# group: GET SHEETS IN SERIES
startsWith_29 = String.StartsWith(str=sheetNumber, searchFor=code_block_2.out28)
filterByBoolMask_29 = List.FilterByBoolMask(list=all_elements_of_category, mask=startsWith_29)

# group: WRITE PARAMETERS TO REVIT
set_sheet_series_parameters_29 = Custom[Set Sheet Series Parameters](element=filterByBoolMask_29.in, Sheet_Series_Title_value=code_block_3.out28, Sheet_Series_value=code_block_2.out28)

# group: GET SHEETS IN SERIES
startsWith_30 = String.StartsWith(str=sheetNumber, searchFor=code_block_2.out29)
filterByBoolMask_30 = List.FilterByBoolMask(list=all_elements_of_category, mask=startsWith_30)

# group: WRITE PARAMETERS TO REVIT
set_sheet_series_parameters_30 = Custom[Set Sheet Series Parameters](element=filterByBoolMask_30.in, Sheet_Series_Title_value=code_block_3.out29, Sheet_Series_value=code_block_2.out29)

# group: GET SHEETS IN SERIES
startsWith_31 = String.StartsWith(str=sheetNumber, searchFor=code_block_2.out30)
filterByBoolMask_31 = List.FilterByBoolMask(list=all_elements_of_category, mask=startsWith_31)

# group: WRITE PARAMETERS TO REVIT
set_sheet_series_parameters_31 = Custom[Set Sheet Series Parameters](element=filterByBoolMask_31.in, Sheet_Series_Title_value=code_block_3.out30, Sheet_Series_value=code_block_2.out30)

# group: GET SHEETS IN SERIES
startsWith_32 = String.StartsWith(str=sheetNumber, searchFor=code_block_2.out31)
filterByBoolMask_32 = List.FilterByBoolMask(list=all_elements_of_category, mask=startsWith_32)

# group: WRITE PARAMETERS TO REVIT
set_sheet_series_parameters_32 = Custom[Set Sheet Series Parameters](element=filterByBoolMask_32.in, Sheet_Series_Title_value=code_block_3.out31, Sheet_Series_value=code_block_2.out31)

# group: GET SHEETS IN SERIES
startsWith_33 = String.StartsWith(str=sheetNumber, searchFor=code_block_2.out32)
filterByBoolMask_33 = List.FilterByBoolMask(list=all_elements_of_category, mask=startsWith_33)

# group: WRITE PARAMETERS TO REVIT
set_sheet_series_parameters_33 = Custom[Set Sheet Series Parameters](element=filterByBoolMask_33.in, Sheet_Series_Title_value=code_block_3.out32, Sheet_Series_value=code_block_2.out32)

# group: GET SHEETS IN SERIES
startsWith_34 = String.StartsWith(str=sheetNumber, searchFor=code_block_2.out33)
filterByBoolMask_34 = List.FilterByBoolMask(list=all_elements_of_category, mask=startsWith_34)

# group: WRITE PARAMETERS TO REVIT
set_sheet_series_parameters_34 = Custom[Set Sheet Series Parameters](element=filterByBoolMask_34.in, Sheet_Series_Title_value=code_block_3.out33, Sheet_Series_value=code_block_2.out33)
