# Dynamo graph MATCH WALL TAGS TO TYPE.dyn (Dynamo 1.2.1.3083)

# group: USER INTERFACE
# note: INPUT + CONTROL

# group: DESIGN
# note: BACK-END FUNCTIONALITY

# group: INPUT
# note: USE:
# FOR FIXED INPUTS, LIKE FILE PATHS OR FIXED NUMBERS OR ELEMENTS THAT NEEDS TO BE
# TYPED BY THE FINAL USER
# note: INPUT

# group: CHANGE FIRE, SMOKE AND ACOUSTIC WALLS TAG
# note: CREATED BY:
# CREATED: 2018.08.15
# VERSION: 1.0
# LAST EDITED: 2018.11.13
# DYNAMO VERSION: Dynamo 1.2.0
# PACKAGES:
# None
# NOTES:
# Should look into optimization, translate the entire script into python.
# Currently is running in nested selections and crossing lacings.

# group: CONTROL
# note: CONTROL
# note: FIXED INPUTS THAT DICTATE WHAT
# THE SCRIPT IS USEFUL FOR

# group: DESIGN
# note: DESIGN
# note: USE:
# FOR GENERAL DEFINITIONS OF NODE BLOCKS

# group: TO REVIT
# note: TO REVIT
# note: USE:
# FOR ANY NODE THAT
# EXPORTS DATA TO REVIT

# group: COMMENTS
# note: COMMENTS
# note: USE:
# FOR ANY COMMENTS OR PROJECT INFO

# group: WIP
# note: WIP
# note: USE:
# FOR UNFINISHED OR UNTESTED
# NODE BLOCKS

# group: INSTRUCTIONS
# note: INSTRUCTIONS:
# ALWAYS SAVE FILE FIRST BEFORE RUNNING A SCRIPT, IT MAY CRASH.
# 1. Insert view's name in yellow group
# Make sure that the view is not cropped, no visible tags won't be changed
# 2. Hit Run
# 3. THE FIRST TIME THE SCRIPT RUNS IT MAY DELETE ALL WALL TAGS. Just redo and hit Run again
# 4. To add new wall types follow instructions in yellow group

# group: ENTER VIEW'S NAME
# note: Not necessary the entire name, but in sufficient length to identify the view specifically
enter_view_s_name = StringInput("A03.04_GENERAL ARRANGEMENT PLAN - L00")

# group: FILTER VIEWS
code_block = CodeBlock { "OST_Views"; }
byName = Category.ByName(code_block)
all_elements_of_category = ElementsOfCategory(byName)
string_from_object = FromObject(all_elements_of_category)
code_block_2 = CodeBlock { true; }
contains = String.Contains(str=string_from_object, searchFor=enter_view_s_name, ignoreCase=code_block_2)
filterByBoolMask = List.FilterByBoolMask(list=all_elements_of_category, mask=contains)
firstItem = List.FirstItem(filterByBoolMask.in)

# group: SELECT ALL WALL TAGS ON VIEW
categories = Categories("WallTags")
byCategoryAndView = Archilab.Grimshaw.Selection.Select.ByCategoryAndView(categories, firstItem)
taggedElement = Tag.TaggedElement(byCategoryAndView)

# group: WALL CODES (ADD NEW MODELS IN ITS RESPECTIVE NODE)
# note: Add new walls' model codes to their respective node blocks, codes must be inside quotation marks and separated by comas
n60_fire_walls_code = CodeBlock()  # "60 Fire Walls Code"
# ---------- n60_fire_walls_code.designscript (3 lines) ----------
{
"FR110"
};
# ----------------------------------------
n120_fire_walls_code = CodeBlock()  # "120 Fire Walls Code"
# ---------- n120_fire_walls_code.designscript (5 lines) ----------
{
"FR130",
"FR180",
"FR181"
};
# ----------------------------------------
n90_fire_walls_code = CodeBlock()  # "90 Fire Walls Code"
# ---------- n90_fire_walls_code.designscript (4 lines) ----------
{
"FR120",
"FR140"
};
# ----------------------------------------
smoke_walls_code = CodeBlock()
# ---------- smoke_walls_code.designscript (3 lines) ----------
{
"SM200"
};
# ----------------------------------------
acoustic_walls_code = CodeBlock()
# ---------- acoustic_walls_code.designscript (9 lines) ----------
{
"AC300",
"AC310",
"AC311",
"AC320",
"AC330",
"AC350",
"AC351"
};
# ----------------------------------------

# group: FILTER WALLS BY TYPE: FIRE RATED 60
code_block_3 = CodeBlock { "Type"; }
parameterByName = Parameter.ParameterByName(element=taggedElement, name=code_block_3)
string_from_object_2 = FromObject(parameterByName)
contains_2 = String.Contains(str=string_from_object_2, searchFor=n60_fire_walls_code, lacing=CrossProduct)
python_script = Python(IN[0]=contains_2)
# ---------- python_script.python (16 lines) ----------
import clr
clr.AddReference('ProtoGeometry')
from Autodesk.DesignScript.Geometry import *
#The inputs to this node will be stored as a list in the IN variables.
dataEnteringNode = IN

for list in dataEnteringNode:
	finalList = []
	for sublist in list:
		if True in sublist:
			finalList.append(True)
		else:
			finalList.append(False)
			
#Assign your output to the OUT variable.
OUT = finalList
# ----------------------------------------
filterByBoolMask_2 = List.FilterByBoolMask(list=byCategoryAndView, mask=python_script)
filterByBoolMask_3 = List.FilterByBoolMask(list=taggedElement, mask=python_script)

code_block_4 = CodeBlock { "Type"; }
code_block_5 = CodeBlock { "TS_TAG - WALL BY TYPE"; }
byName_2 = Family.ByName(code_block_5)
types = Family.Types(byName_2)
string_from_object_3 = FromObject(types)
code_block_6 = CodeBlock { "60"; }
contains_3 = String.Contains(str=string_from_object_3, searchFor=code_block_6)
filterByBoolMask_4 = List.FilterByBoolMask(list=types, mask=contains_3)
firstItem_2 = List.FirstItem(filterByBoolMask_4.in)
setParameterByName = Element.SetParameterByName(element=filterByBoolMask_2.in, parameterName=code_block_4, value=firstItem_2)

# group: FILTER WALLS BY TYPE: FIRE RATED 120
code_block_7 = CodeBlock { "Type"; }
parameterByName_2 = Parameter.ParameterByName(element=filterByBoolMask_3.out, name=code_block_7)
string_from_object_4 = FromObject(parameterByName_2)
contains_4 = String.Contains(str=string_from_object_4, searchFor=n120_fire_walls_code, lacing=CrossProduct)
python_script_2 = Python(IN[0]=contains_4)  # same code as python_script
filterByBoolMask_5 = List.FilterByBoolMask(list=filterByBoolMask_2.out, mask=python_script_2)
filterByBoolMask_6 = List.FilterByBoolMask(list=filterByBoolMask_3.out, mask=python_script_2)

code_block_8 = CodeBlock { "Type"; }
code_block_9 = CodeBlock { "TS_TAG - WALL BY TYPE"; }
byName_3 = Family.ByName(code_block_9)
types_2 = Family.Types(byName_3)
string_from_object_5 = FromObject(types_2)
code_block_10 = CodeBlock { "120"; }
contains_5 = String.Contains(str=string_from_object_5, searchFor=code_block_10)
filterByBoolMask_7 = List.FilterByBoolMask(list=types_2, mask=contains_5)
firstItem_3 = List.FirstItem(filterByBoolMask_7.in)
setParameterByName_2 = Element.SetParameterByName(element=filterByBoolMask_5.in, parameterName=code_block_8, value=firstItem_3)

# group: FILTER WALLS BY TYPE: FIRE RATED 90
code_block_11 = CodeBlock { "Type"; }
parameterByName_3 = Parameter.ParameterByName(element=filterByBoolMask_6.out, name=code_block_11)
string_from_object_6 = FromObject(parameterByName_3)
contains_6 = String.Contains(str=string_from_object_6, searchFor=n90_fire_walls_code, lacing=CrossProduct)
python_script_3 = Python(IN[0]=contains_6)  # same code as python_script
filterByBoolMask_8 = List.FilterByBoolMask(list=filterByBoolMask_5.out, mask=python_script_3)
filterByBoolMask_9 = List.FilterByBoolMask(list=filterByBoolMask_6.out, mask=python_script_3)

# group: FILTER WALLS BY TYPE: FIRE WALL TICKED
code_block_12 = CodeBlock { "Fire Wall"; }
parameterByName_4 = Parameter.ParameterByName(element=filterByBoolMask_9.out, name=code_block_12)
string_from_object_7 = FromObject(parameterByName_4)
python_script_4 = Python(IN[0]=string_from_object_7)
# ---------- python_script_4.python (15 lines) ----------
import clr
clr.AddReference('ProtoGeometry')
from Autodesk.DesignScript.Geometry import *
#The inputs to this node will be stored as a list in the IN variables.
dataEnteringNode = IN

finalList = []
for list in dataEnteringNode:
	for element in list:
		if "Yes" in element:
			finalList.append(True)
		else:
			finalList.append(False)
#Assign your output to the OUT variable.
OUT = finalList
# ----------------------------------------
filterByBoolMask_10 = List.FilterByBoolMask(list=filterByBoolMask_8.out, mask=python_script_4)
filterByBoolMask_11 = List.FilterByBoolMask(list=filterByBoolMask_9.out, mask=python_script_4)

# group: FILTER WALLS BY TYPE: SMOKE
code_block_13 = CodeBlock { "Type"; }
parameterByName_5 = Parameter.ParameterByName(element=filterByBoolMask_11.out, name=code_block_13)
string_from_object_8 = FromObject(parameterByName_5)
contains_7 = String.Contains(str=string_from_object_8, searchFor=smoke_walls_code, lacing=CrossProduct)
python_script_5 = Python(IN[0]=contains_7)  # same code as python_script
filterByBoolMask_12 = List.FilterByBoolMask(list=filterByBoolMask_10.out, mask=python_script_5)
filterByBoolMask_13 = List.FilterByBoolMask(list=filterByBoolMask_11.out, mask=python_script_5)

code_block_14 = CodeBlock { "Type"; }
code_block_15 = CodeBlock { "TS_TAG - WALL BY TYPE"; }
byName_4 = Family.ByName(code_block_15)
types_3 = Family.Types(byName_4)
string_from_object_9 = FromObject(types_3)
code_block_16 = CodeBlock { "SMOKE"; }
contains_8 = String.Contains(str=string_from_object_9, searchFor=code_block_16)
filterByBoolMask_14 = List.FilterByBoolMask(list=types_3, mask=contains_8)
firstItem_4 = List.FirstItem(filterByBoolMask_14.in)
setParameterByName_3 = Element.SetParameterByName(element=filterByBoolMask_12.in, parameterName=code_block_14, value=firstItem_4)

# group: FILTER WALLS BY TYPE: FIRE WALL TICKED
code_block_17 = CodeBlock { "Smoke Wall"; }
parameterByName_6 = Parameter.ParameterByName(element=filterByBoolMask_9.out, name=code_block_17)
string_from_object_10 = FromObject(parameterByName_6)
python_script_6 = Python(IN[0]=string_from_object_10)  # same code as python_script_4
filterByBoolMask_15 = List.FilterByBoolMask(list=filterByBoolMask_12.out, mask=python_script_6)
filterByBoolMask_16 = List.FilterByBoolMask(list=filterByBoolMask_13.out, mask=python_script_6)

code_block_18 = CodeBlock { "Type"; }
parameterByName_7 = Parameter.ParameterByName(element=filterByBoolMask_16.out, name=code_block_18)
string_from_object_11 = FromObject(parameterByName_7)
contains_9 = String.Contains(str=string_from_object_11, searchFor=acoustic_walls_code, lacing=CrossProduct)
python_script_7 = Python(IN[0]=contains_9)  # same code as python_script
filterByBoolMask_17 = List.FilterByBoolMask(list=filterByBoolMask_15.out, mask=python_script_7)
code_block_19 = CodeBlock { "Type"; }
code_block_20 = CodeBlock { "TS_TAG - WALL BY TYPE"; }
byName_5 = Family.ByName(code_block_20)
types_4 = Family.Types(byName_5)
string_from_object_12 = FromObject(types_4)
code_block_21 = CodeBlock { "ACOUSTIC"; }
contains_10 = String.Contains(str=string_from_object_12, searchFor=code_block_21)
filterByBoolMask_18 = List.FilterByBoolMask(list=types_4, mask=contains_10)
firstItem_5 = List.FirstItem(filterByBoolMask_18.in)
setParameterByName_4 = Element.SetParameterByName(element=filterByBoolMask_17.in, parameterName=code_block_19, value=firstItem_5)
code_block_22 = CodeBlock { "Type"; }
code_block_23 = CodeBlock { "TS_TAG - WALL BY TYPE"; }
byName_6 = Family.ByName(code_block_23)
types_5 = Family.Types(byName_6)
string_from_object_13 = FromObject(types_5)
code_block_24 = CodeBlock { "TAG BY TYPE"; }
contains_11 = String.Contains(str=string_from_object_13, searchFor=code_block_24)
filterByBoolMask_19 = List.FilterByBoolMask(list=types_5, mask=contains_11)
firstItem_6 = List.FirstItem(filterByBoolMask_19.in)
setParameterByName_5 = Element.SetParameterByName(element=filterByBoolMask_17.out, parameterName=code_block_22, value=firstItem_6)
code_block_25 = CodeBlock { "TS_TAG - WALL BY TYPE"; }
byName_7 = Family.ByName(code_block_25)
types_6 = Family.Types(byName_7)
string_from_object_14 = FromObject(types_6)
code_block_26 = CodeBlock { "90"; }
contains_12 = String.Contains(str=string_from_object_14, searchFor=code_block_26)
filterByBoolMask_20 = List.FilterByBoolMask(list=types_6, mask=contains_12)
firstItem_7 = List.FirstItem(filterByBoolMask_20.in)

# group: FIRE WALL 90
code_block_27 = CodeBlock { "Type"; }
setParameterByName_6 = Element.SetParameterByName(element=filterByBoolMask_8.in, parameterName=code_block_27, value=firstItem_7)

code_block_28 = CodeBlock { "TS_TAG - WALL BY TYPE"; }
byName_8 = Family.ByName(code_block_28)
types_7 = Family.Types(byName_8)
string_from_object_15 = FromObject(types_7)
code_block_29 = CodeBlock { "90"; }
contains_13 = String.Contains(str=string_from_object_15, searchFor=code_block_29)
filterByBoolMask_21 = List.FilterByBoolMask(list=types_7, mask=contains_13)
firstItem_8 = List.FirstItem(filterByBoolMask_21.in)

# group: FIRE WALL 90
code_block_30 = CodeBlock { "Type"; }
setParameterByName_7 = Element.SetParameterByName(element=filterByBoolMask_10.in, parameterName=code_block_30, value=firstItem_8)

code_block_31 = CodeBlock { "Type"; }
code_block_32 = CodeBlock { "TS_TAG - WALL BY TYPE"; }
byName_9 = Family.ByName(code_block_32)
types_8 = Family.Types(byName_9)
string_from_object_16 = FromObject(types_8)
code_block_33 = CodeBlock { "SMOKE"; }
contains_14 = String.Contains(str=string_from_object_16, searchFor=code_block_33)
filterByBoolMask_22 = List.FilterByBoolMask(list=types_8, mask=contains_14)
firstItem_9 = List.FirstItem(filterByBoolMask_22.in)
setParameterByName_8 = Element.SetParameterByName(element=filterByBoolMask_15.in, parameterName=code_block_31, value=firstItem_9)
