# Dynamo graph MATRIX ALONG CURVES.dyn (Dynamo 1.2.1.3083)

# group: DESIGN
# note: BACK-END FUNCTIONALITY

# group: USER INTERFACE
# note: INPUT + CONTROL

# group: WIP
# note: USE:
# FOR UNFINISHED OR UNTESTED
# NODE BLOCKS
# note: WIP

# group: COMMENTS
# note: USE:
# FOR ANY COMMENTS OR PROJECT INFO
# note: COMMENTS

# group: TO REVIT
# note: USE:
# FOR ANY NODE THAT
# EXPORTS DATA TO REVIT
# note: TO REVIT

# group: INPUT
# note: USE:
# FOR FIXED INPUTS, LIKE FILE PATHS OR FIXED NUMBERS OR ELEMENTS THAT NEEDS TO BE
# TYPED BY THE FINAL USER
# note: INPUT

# group: CONTROL
# note: FIXED INPUTS THAT DICTATE WHAT
# THE SCRIPT IS USEFUL FOR
# note: CONTROL

# group: DESIGN
# note: USE:
# FOR GENERAL DEFINITIONS OF NODE BLOCKS
# note: DESIGN

# group: MATRIX ALONG CURVE
# note: CREATED BY:
# CREATED: 2018.08.15
# VERSION: 1.0
# LAST EDITED: 2019.01.11
# DYNAMO VERSION: Dynamo 1.2.0
# PACKAGES:
# Rythm
# NOTES:
# If a second execution of the script does not work, close and reopen the script

# group: INSTRUCTIONS
# note: INSTRUCTIONS:
# 1. Fill in the required fields inside the yellow group
# 2. Click on Run
# 3. rename the group if you want to create a new matrix

# group: IF CHANGE TO DYNAMO PLAYER, USE THIS NODE
# note: USE THIS NODE WITH DYNAMO PLAYER
# note: Rhythm
pick_model_element = Custom[Pick Model Element]()  # This offers a single selection of a model element. Created for Dynamo Player usage.

# group: INPUT
element_to_place = FamilyTypes("RPC Tree - Deciduous:American Beech - 6.0 Meters")
# note: Rhythm
pick_model_elements = Custom[Pick Model Elements]()  # This node offers a pick method for selecting elements in Revit.
curve = Grid.Curve(pick_model_elements)
number_of_divisions = IntegerSlider(10, range=0..1500 step 1)
level_to_place_the_elements = Levels("L00")
name_for_the_group = StringInput("MATRIX GROUP 1")

# group: DIVIDE CLOSED CURVE
startPoint = Curve.StartPoint(curve)
pointsAtEqualSegmentLength = Curve.PointsAtEqualSegmentLength(curve=curve, divisions=number_of_divisions)
addItemToFront = List.AddItemToFront(item=startPoint, list=pointsAtEqualSegmentLength)

# group: DIVIDE OPEN CURVE
endPoint = Curve.EndPoint(curve)
addItemToEnd = List.AddItemToEnd(item=endPoint, list=addItemToFront)

# group: CHECK IF CURVE IS OPEN OR CLOSED
code_block = CodeBlock()
# ---------- code_block.designscript (15 lines) ----------
def oldif(test, iftrue:var[]..[],
iffalse:var[]..[])
{
return = [Imperative]
{
if (test)
{
return = iftrue;
}
else
{
return = iffalse;
}
}
};
# ----------------------------------------
endPoint_2 = Curve.EndPoint(curve)
string_from_object = FromObject(endPoint_2)
startPoint_2 = Curve.StartPoint(curve)
string_from_object_2 = FromObject(startPoint_2)
ne = string_from_object != string_from_object_2
if_ = CodeBlock(x=ne, y=addItemToEnd, z=addItemToFront) { oldif(x,y,z); }

# group: GET POINTS AND TANGENT IN THOSE POINTS
parameterAtPoint = Curve.ParameterAtPoint(curve=curve, point=if_)
tangentAtParameter = Curve.TangentAtParameter(curve, parameterAtPoint)
XAxis = Vector.XAxis()
ZAxis = Vector.ZAxis()
angleAboutAxis = Vector.AngleAboutAxis(tangentAtParameter, XAxis, ZAxis)
round = Math.Round(angleAboutAxis)

# group: PLACE ELEMENTS IN REVIT AND GROUP THEM
byPointAndLevel = FamilyInstance.ByPointAndLevel(familyType=element_to_place, point=if_, level=level_to_place_the_elements)
setRotation = FamilyInstance.SetRotation(familyInstance=byPointAndLevel, degree=round)
fromElements = Custom[Group.FromElements](elements=setRotation, groupName=name_for_the_group)  # Creates a group from a list of Revit elements
