# Dynamo graph Matrix Along Curve Pyhton.dyn (Dynamo 2.0.2.6826)

# group: INSTRUCTIONS
# note: INSTRUCTIONS:
# 1. Fill in the required fields inside the yellow group
# 2. Click on Run
# 3. rename the group if you want to create a new matrix

# group: BACK-END
# note: BACK-END FUNCTIONALITY

# group: USER INTERFACE
# note: INPUT

# group: WIP
# note: USE:
# FOR UNFINISHED OR UNTESTED
# BLOCKS OF CODE
# note: WIP

# group: TO REVIT
# note: USE:
# FOR ANY GROUP THAT
# WRITES DATA TO REVIT
# note: TO REVIT

# group: DESIGN
# note: USE:
# FOR BLOCKS OF CODE THAT DO A SPECIFIC TASK
# note: DESIGN

# group: COMMENTS
# note: USE:
# FOR ANY COMMENTS OR PROJECT INFO
# note: COMMENTS

# group: INPUT
# note: USE:
# INPUTS THAT ARE REQUIRED TO BE
# SET BY THE USER
# note: INPUT

# group: MATRIX ALONG CURVE
# note: CREATED BY:
# CREATED: 2018-08-21
# VERSION:
# LAST EDITED: 2019-01-21
# DYNAMO VERSION: 2.0
# PACKAGES:
# Clockwork
# NOTES:

# group: INPUT
select_model_curve = DSModelElementSelection()  # 1 picked in the model; graph input
element_to_place_along_matrix = FamilyTypes(index=71)  # graph input
level_to_place_the_elements = Levels(index=0)  # graph input
name_for_the_group = StringInput("MATRIX GROUP 1")  # graph input
number_of_elements = IntegerSlider(20, range=0..1500 step 1)  # graph input

# group: Create Matrix and Group
matrix_of_elements_along_a_curve = Python(IN[0]=select_model_curve, IN[1]=element_to_place_along_matrix, IN[2]=level_to_place_the_elements, IN[3]=name_for_the_group, IN[4]=number_of_elements)
# ---------- matrix_of_elements_along_a_curve.python (109 lines) ----------
# Import math module to transform degrees to radians
import math

# Import commom language runtime and required libraries
import clr

clr.AddReference('RevitAPI')
from Autodesk.Revit.DB import FilteredElementCollector, ElementTransformUtils, ElementId
from Autodesk.Revit.DB.Structure import StructuralType

clr.AddReference('ProtoGeometry')
from Autodesk.DesignScript.Geometry import Vector, Line

clr.AddReference('System')
from System.Collections.Generic import List

clr.AddReference('RevitNodes')
import Revit
clr.ImportExtensions(Revit.GeometryConversion)
clr.ImportExtensions(Revit.Elements)

clr.AddReference('RevitServices')
import RevitServices
from RevitServices.Persistence import DocumentManager
from RevitServices.Transactions import TransactionManager

# Create variables to store current document
doc = DocumentManager.Instance.CurrentDBDocument
uidoc=DocumentManager.Instance.CurrentUIApplication.ActiveUIDocument

# IN variables
# Get the underlaying geometry of the modelcurve
curve = IN[0].Curve
# Unwrap Revit elements so Dynamo can use it
familyInstance = UnwrapElement(IN[1])
level = UnwrapElement(IN[2])
groupname = IN[3]
numberElements = IN[4]

# Check start and end points of the curve
startPoint = curve.StartPoint
endPoint = curve.EndPoint

# Divide curve
dividedCurve = curve.PointsAtEqualSegmentLength(numberElements)

# Division points of the curve
finalCurve = list()

# Check if the strings of startPoint and endPoint are the same
if str(startPoint) == str(endPoint):
	# Closed curve, it needs only to add the start point
	finalCurve.append(startPoint)
	for el in dividedCurve:
		finalCurve.append(el)
else:
	# Open curve, needs both start and end points
	finalCurve.append(startPoint)
	for el in dividedCurve:
		finalCurve.append(el)
	finalCurve.append(endPoint)

# Create a list with tangent vectors to the curve at the division points
tangVector = list()

for point in finalCurve:
	tangVector.append(curve.TangentAtParameter(curve.ParameterAtPoint(point)))
	
# Create a list with the angle between the tangent vector and the curve	in radians
angleRot = list()
vectorX = Vector.XAxis()
vectorZ = Vector.ZAxis()

for vec in tangVector:
	angleRot.append(-vec.AngleAboutAxis(vectorX, vectorZ) * math.pi/180)

# Open transaction to place all the family instances
TransactionManager.Instance.EnsureInTransaction(doc)

instances = list()
i = 0

for point in finalCurve:
	# Define line as axis of rotation
	vec = Line.ByStartPointDirectionLength(point, vectorZ, 1).ToRevitType()
	# Instantiate family
	instance = doc.Create.NewFamilyInstance(point.ToXyz(), familyInstance, StructuralType.NonStructural)
	# Rotate family instances
	ElementTransformUtils.RotateElement(doc, instance.Id, vec, angleRot[i])
	
	i += 1
	# Create list of elements id 
	instances.append(instance.Id)

# Create an equivalent of ICollection of ids
items = List[ElementId](instances)

# Try to create the group, return empty list in case it fails
try:
	group = doc.Create.NewGroup(items);
	group.GroupType.Name = IN[3]
except:
	group = list()
	
# End Transaction
TransactionManager.Instance.TransactionTaskDone()

# Assign your output to the OUT variable.
OUT = group
# ----------------------------------------

python_script = Python()  # unwired: IN[0]
# ---------- python_script.python (26 lines) ----------
# Enable Python support and load DesignScript library
import clr
clr.AddReference('RevitNodes')
import Revit
clr.ImportExtensions(Revit.Elements)

clr.AddReference("RevitServices")
import RevitServices
from RevitServices.Persistence import DocumentManager

clr.AddReference("RevitAPI")
import Autodesk
from Autodesk.Revit.DB import *

import System
from System.Collections.Generic import *

doc = DocumentManager.Instance.CurrentDBDocument


collector = FilteredElementCollector(doc).OfClass(FamilySymbol).ToElements()

# Place your code below this line

# Assign your output to the OUT variable.
OUT = collector
# ----------------------------------------
python_script_2 = Python(IN[0]=python_script)  # frozen
# ---------- python_script_2.python (78 lines) ----------
import clr

# Verify these are needed.
clr.AddReference('System')
clr.AddReference('System.Drawing')
clr.AddReference("System.Windows.Forms")

#  Windows Forms Elements
from System.Drawing import Point, Icon, Color
from System.Windows import Forms
from System.Windows.Forms import Application, Form
from System.Windows.Forms import DialogResult, GroupBox, FormBorderStyle
from System.Windows.Forms import ComboBox, Button, DialogResult

families = IN[0]

class SelectFromList(Form):

    """
    form = SelectFromList(floor_types.keys())
    form.show()
    if form.DialogResult == DialogResult.OK:
        chosen_type_name = form.selected
    """

    def __init__(self):
        """
        Args:
            title (str): Title of Prompt
            options (dict): Name:Object
            **sort (bool): Sort Entries
        """
        
        options = families

        self.selected = None
        options = sorted(options)

        #  Window Settings
        self.Text = 'Select View Type'
        self.MinimizeBox = False
        self.MaximizeBox = False
        self.BackgroundColor = Color.White
        self.FormBorderStyle = FormBorderStyle.FixedSingle
        self.ShowIcon = False

        combobox = ComboBox()
        combobox.Width = 200
        combobox.Height = 20
        combobox.DataSource = options
        self.combobox = combobox

        button = Button()
        button.Text = 'Select'
        button.Location = Point(0,20)
        button.Width = combobox.Width
        button.Height = 20
        button.Click += self.button_click

        self.Width = combobox.Width + 16
        self.Height = 80

        self.Controls.Add(combobox)
        self.Controls.Add(button)

    def button_click(self, sender, event):
        self.selected = self.combobox.SelectedValue
        self.DialogResult = DialogResult.OK
        self.Close()

    def show(self):
        """ Show Dialog """
        self.ShowDialog()
        
comb = SelectFromList()
comboBox = Application.Run(comb)

OUT = comb.selected
# ----------------------------------------
matrix_of_elements_along_a_curve_2 = Python()  # frozen; unwired: IN[0], IN[1], IN[2], IN[3], IN[4]
# ---------- matrix_of_elements_along_a_curve_2.python (251 lines) ----------
# Import commom language runtime
import clr

clr.AddReference('RevitAPI')
from Autodesk.Revit.DB import FilteredElementCollector
# from Autodesk.Revit.DB.Structure import *

clr.AddReference('ProtoGeometry')
from Autodesk.DesignScript.Geometry import *

clr.AddReference('RevitAPIUI')
from Autodesk.Revit.UI import *

clr.AddReference('System')
from System.Collections.Generic import List

clr.AddReference('RevitNodes')
import Revit
clr.ImportExtensions(Revit.GeometryConversion)
clr.ImportExtensions(Revit.Elements)

clr.AddReference('RevitServices')
import RevitServices
from RevitServices.Persistence import DocumentManager
from RevitServices.Transactions import TransactionManager

# Import modules to create windows dialogues in Revit for user input
clr.AddReference('System.Windows.Forms')
clr.AddReference('System.Drawing')
from System.Windows.Forms import *
from System.Drawing import *

# Import math module
import math

# Create variables to store current document
doc = DocumentManager.Instance.CurrentDBDocument
uidoc=DocumentManager.Instance.CurrentUIApplication.ActiveUIDocument

# Pick model curve in Revit document to place elements
# Code based on john pierson´s isolated select model elements node
TaskDialog.Show("Isolated Selection", "Pick curve to follow path")

sel1 = uidoc.Selection
obt1 = Selection.ObjectType.Element

# Define class to filter elements of category to select 
class CustomISelectionFilter(Selection.ISelectionFilter):
	def __init__(self, nom_categorie):
		self.nom_categorie = nom_categorie
	def AllowElement(self, e):
		if e.Category.Name == self.nom_categorie:
			return True
		else:
			return False
	def AllowReference(self, ref, point):
		return true

el_ref = sel1.PickObject(obt1, CustomISelectionFilter("Lines"))
		
# Stores the selected modelcurve into curve, marks it as Revit owned element and extracts geometry
curve = doc.GetElement(el_ref.ElementId).ToDSType(True).Curve

# Create a class form
class CreateWindow(Form):
	def __init__(self):
		# Create the form
		self.Name = "Create Window"
		self.Text = "Input number of divisions"
		self.Size = Size(500, 150)
		self.CenterToScreen()
		
		self.values = 0
		
		# Create label for number of divisions
		labelDiv = Label(Text = "Number of elements to place: ")
		labelDiv.Parent = self
		labelDiv.Size = Size(200, 150)
		labelDiv.Location = Point(30, 20)
		
		# Create TextBox for number of divisions
		self.textboxDiv = TextBox()
		self.textboxDiv.Parent = self
		self.textboxDiv.Text = "10"
		self.textboxDiv.Location = Point(300, 20)
	
		# Create button
		button = Button()
		button.Parent = self
		button.Text = "Ok"
		button.Location = Point(300, 60)
		
		# Register event
		button.Click += self.ButtonClicked
		
	def ButtonClicked(self, sender, args):
		if sender.Click:
			# Handle non numeric cases
			try:
				self.values = round(float(self.textboxDiv.Text))
				self.Close()
			except:
				labelDiv = Label(Text = "Enter number please: ")

# Call the CreateWindow class and create the input for number of divisions
form = CreateWindow()
Application.Run(form)

# Assign the inout to numberElements
numberElements = form.values

collector = FilteredElementCollector(doc).OfClass(FamilySymbol).ToElements()

class SelectFromList(Form):

    """
    form = SelectFromList(floor_types.keys())
    form.show()
    if form.DialogResult == DialogResult.OK:
        chosen_type_name = form.selected
    """

    def __init__(self):
        
	    """
	    form = SelectFromList(floor_types.keys())
	    form.show()
	    if form.DialogResult == DialogResult.OK:
	        chosen_type_name = form.selected
	    """

    def __init__(self, title, options):
        """
        Args:
            title (str): Title of Prompt
            options (dict): Name:Object
            **sort (bool): Sort Entries
        """


        self.selected = None
        options = sorted(options)

        #  Window Settings
        self.Text = 'Select View Type'
        self.MinimizeBox = False
        self.MaximizeBox = False
        self.BackgroundColor = Color.White
        self.FormBorderStyle = FormBorderStyle.FixedSingle
        self.ShowIcon = False
        self.CenterToScreen()

        combobox = ComboBox()
        combobox.Width = 500
        combobox.Height = 300
        combobox.DataSource = options
        self.combobox = combobox

        button = Button()
        button.Text = 'Select'
        button.Location = Point(0,100)
        button.Width = combobox.Width
        button.Height = 50
        button.Click += self.button_click

        self.Width = combobox.Width + 16
        self.Height = 300

        self.Controls.Add(combobox)
        self.Controls.Add(button)

    def button_click(self, sender, event):
        self.selected = self.combobox.SelectedValue
        self.DialogResult = DialogResult.OK
        self.Close()

    def show(self):
        """ Show Dialog """
        self.ShowDialog()
        
comb = SelectFromList("Select family to place in points", collector)
comboBox = Application.Run(comb)

familyInstance = comb.selected

# Check start and end points of the curve
startPoint = curve.StartPoint
endPoint = curve.EndPoint

# Divide curve
dividedCurve = curve.PointsAtEqualSegmentLength(numberElements)
finalCurve = list()

# Check if the strings of startPoint and endPoint are the same
if str(startPoint) == str(endPoint):
	# Closed curve, it needs only to add the start point
	finalCurve.append(startPoint)
	for el in dividedCurve:
		finalCurve.append(el)
else:
	# Open curve, needs both start and end points
	finalCurve.append(startPoint)
	for el in dividedCurve:
		finalCurve.append(el)
	finalCurve.append(endPoint)

# Create a list with tangent vectors to the curve at the division points
tangVector = list()

for point in finalCurve:
	tangVector.append(curve.TangentAtParameter(curve.ParameterAtPoint(point)))
	
# Create a list with the angle between the tangent vector and the curve	in radians
angleRot = list()
vectorX = Vector.XAxis()
vectorZ = Vector.ZAxis()

for vec in tangVector:
	angleRot.append(-vec.AngleAboutAxis(vectorX, vectorZ) * math.pi/180)

# Open transaction to place all the family instances
TransactionManager.Instance.EnsureInTransaction(doc)

instances = list()
placePoint = []
i = 0

for point in finalCurve:

	vec = Line.ByStartPointDirectionLength(point, vectorZ, 1).ToRevitType()
	
	instance = doc.Create.NewFamilyInstance(point.ToXyz(), familyInstance, StructuralType.NonStructural)
	ElementTransformUtils.RotateElement(doc, instance.Id, vec, angleRot[i])
	i = i +1
	
	instances.append(instance.Id)
	placePoint.append(instance.GetFamilyPointPlacementReferences())

items = List[ElementId](instances)

try:
	group = doc.Create.NewGroup(items);
	group.GroupType.Name = IN[3]
except:
	group = list()
	
# End Transaction
TransactionManager.Instance.TransactionTaskDone()

# Assign your output to the OUT variable.
OUT = instances
# ----------------------------------------
