# Dynamo graph Matrix Along Curve.dyn (Dynamo 2.0.2.6826)

# group: INSTRUCTIONS
# note: INSTRUCTIONS:
# 1. Fill in the required fields inside the yellow group
# 2. Click on Run
# 3. rename the group if you want to create a new matrix

# group: BACK-END
# note: BACK-END FUNCTIONALITY

# group: USER INTERFACE
# note: INPUT

# group: WIP
# note: USE:
# FOR UNFINISHED OR UNTESTED
# BLOCKS OF CODE
# note: WIP

# group: TO REVIT
# note: USE:
# FOR ANY GROUP THAT
# WRITES DATA TO REVIT
# note: TO REVIT

# group: DESIGN
# note: USE:
# FOR BLOCKS OF CODE THAT DO A SPECIFIC TASK
# note: DESIGN

# group: COMMENTS
# note: USE:
# FOR ANY COMMENTS OR PROJECT INFO
# note: COMMENTS

# group: INPUT
# note: USE:
# INPUTS THAT ARE REQUIRED TO BE
# SET BY THE USER
# note: INPUT

# group: MATRIX ALONG CURVE
# note: CREATED BY:
# CREATED: 2018-08-21
# VERSION:
# LAST EDITED: 2019-01-21
# DYNAMO VERSION: 2.0
# PACKAGES:
# Clockwork
# NOTES:

# group: INPUT
element_to_place_along_matrix = FamilyTypes(index=71)  # graph input
select_model_curve = DSModelElementSelection()  # 1 picked in the model; graph input
number_of_elements = IntegerSlider(16, range=0..1500 step 1)  # graph input
level_to_place_the_elements = Levels(index=0)  # graph input
name_for_the_group = StringInput("MATRIX GROUP 1")  # graph input

# group: DIVIDE CURVE
curves = Element.Curves(element=select_model_curve)
pointsAtEqualSegmentLength = Curve.PointsAtEqualSegmentLength(curve=curves, divisions=number_of_elements)

# group: CLOSED CURVE CASE
startPoint = Curve.StartPoint(curve=curves)
addItemToFront = List.AddItemToFront(item=startPoint, list=pointsAtEqualSegmentLength)

# group: OPEN CURVE CASE
endPoint = Curve.EndPoint(curve=curves)
addItemToEnd = List.AddItemToEnd(item=endPoint, list=addItemToFront)

# group: CHECK IF CURVE IS OPEN OR CLOSED
endPoint_2 = Curve.EndPoint(curve=curves)
string_from_object = FromObject(obj=endPoint_2)
startPoint_2 = Curve.StartPoint(curve=curves)
string_from_object_2 = FromObject(obj=startPoint_2)
ne = string_from_object != string_from_object_2
python_script = Python(IN[0]=ne, IN[1]=addItemToEnd, IN[2]=addItemToFront)
# ---------- python_script.python (14 lines) ----------
# The inputs to this node will be stored as a list in the IN variables.
toggle = IN[0]
data1 = IN[1]
data2 = IN[2]

result = data2

# If 

if toggle[0] == True:
	result = data1

# Assign your output to the OUT variable.
OUT = result
# ----------------------------------------
flatten = List.Flatten(list=python_script)

# group: GET POINTS AND TANGENT IN THOSE POINTS
parameterAtPoint = Curve.ParameterAtPoint(curve=curves, point=flatten, lacing=Longest)
tangentAtParameter = Curve.TangentAtParameter(curve=curves, param=parameterAtPoint, lacing=Longest)
XAxis = Vector.XAxis()
ZAxis = Vector.ZAxis()
angleAboutAxis = Vector.AngleAboutAxis(vector=tangentAtParameter, otherVector=XAxis, rotationAxis=ZAxis)
round = Math.Round(number=angleAboutAxis)

# group: PLACE ELEMENTS IN REVIT AND GROUP THEM
byPointAndLevel = FamilyInstance.ByPointAndLevel(familyType=element_to_place_along_matrix, point=flatten, level=level_to_place_the_elements)  # frozen
setRotation = FamilyInstance.SetRotation(familyInstance=byPointAndLevel, degree=round)
# note: Clockwork
fromElements = Custom[Group.FromElements](elements=setRotation, groupName=name_for_the_group)  # Creates a group from a list of Revit elements
