# Dynamo graph Matrix-Curves.dyn (Dynamo 1.3.2.2480)

# group: input
# note: Instrucciones:
# 1. Descargar paquete Rhythm de Paquetes>Buscar un paquete
# 2. Seleccionar de familias el tipo de familia que se va a colocar en los puntos de la matriz
# 3. Seleccionar nivel en donde se colocarán los elementos
# 4. Ejecutar el script y se pedirá seleccionar  la curva
# note: Rhythm
pick_model_element = Custom[Pick Model Element]()  # This offers a single selection of a model element. Created for Dynamo Player usage.
curve = Grid.Curve(pick_model_element)

# group: divide closed curve
startPoint = Curve.StartPoint(curve)
número_de_divisiones = DoubleInput(10)
pointsAtEqualSegmentLength = Curve.PointsAtEqualSegmentLength(curve=curve, divisions=número_de_divisiones)
addItemToFront = List.AddItemToFront(item=startPoint, list=pointsAtEqualSegmentLength)

# group: divide open curve
endPoint = Curve.EndPoint(curve)
addItemToEnd = List.AddItemToEnd(item=endPoint, list=addItemToFront)

# group: open or closed?
code_block = CodeBlock()
# ---------- code_block.designscript (15 lines) ----------
def oldif(test, iftrue:var[]..[],
iffalse:var[]..[])
{
return = [Imperative]
{
if (test)
{
return = iftrue;
}
else
{
return = iffalse;
}
}
};
# ----------------------------------------
endPoint_2 = Curve.EndPoint(curve)
string_from_object = FromObject(endPoint_2)
startPoint_2 = Curve.StartPoint(curve)
string_from_object_2 = FromObject(startPoint_2)
ne = string_from_object != string_from_object_2
if_ = CodeBlock(x=ne, y=addItemToEnd, z=addItemToFront) { oldif(x,y,z); }

# group: get points and tangents at points
parameterAtPoint = Curve.ParameterAtPoint(curve=curve, point=if_)
tangentAtParameter = Curve.TangentAtParameter(curve, parameterAtPoint)
XAxis = Vector.XAxis()
ZAxis = Vector.ZAxis()
angleAboutAxis = Vector.AngleAboutAxis(tangentAtParameter, XAxis, ZAxis)
round = Math.Round(angleAboutAxis)

# group: Place elements in points along curve
elemento_a_colocar_en_matriz = FamilyTypes()
nivel_de_colocación_de_elementos = Levels()
byPointAndLevel = FamilyInstance.ByPointAndLevel(familyType=elemento_a_colocar_en_matriz, point=if_, level=nivel_de_colocación_de_elementos)
setRotation = FamilyInstance.SetRotation(familyInstance=byPointAndLevel, degree=round)
