# Dynamo graph NUMBER PARKING SPACES.dyn (Dynamo 1.2.1.3083)

# group: USER INTERFACE
# note: INPUT + CONTROL

# group: DESIGN
# note: BACK-END FUNCTIONALITY

# group: POPULATE PARKING MARK PARAMETER AND TAG ALL
# note: CREATED BY:
# CREATED: 2018.08.15
# VERSION: 1.0
# LAST EDITED: 2018.08.15
#          2018.08.24
# DYNAMO VERSION: Dynamo 1.2.0
# PACKAGES:
# None
# NOTES:
# The script selects all parking bays, fills its Mark parameter and tags all of them in the selected view.
# It filters out the Accessible parking shared area (in case the family name changes it must be changed here as well).

# group: INSTRUCTIONS
# note: INSTRUCTIONS:
# 1. Write down the view's name in the node inside the yellow box
# 2. Click on the "Run" botton at the bottom left fo the program
# 3. All parking bays should be tagged in that view

# group: WIP
# note: USE:
# FOR UNFINISHED OR UNTESTED
# NODE BLOCKS
# note: WIP

# group: COMMENTS
# note: USE:
# FOR ANY COMMENTS OR PROJECT INFO
# note: COMMENTS

# group: TO REVIT
# note: USE:
# FOR ANY NODE THAT
# EXPORTS DATA TO REVIT
# note: TO REVIT

# group: INPUT
# note: USE:
# FOR FIXED INPUTS, LIKE FILE PATHS OR FIXED NUMBERS OR ELEMENTS THAT NEEDS TO BE
# TYPED BY THE FINAL USER
# note: INPUT

# group: CONTROL
# note: FIXED INPUTS THAT DICTATE WHAT
# THE SCRIPT IS USEFUL FOR
# note: CONTROL

# group: DESIGN
# note: USE:
# FOR GENERAL DEFINITIONS OF NODE BLOCKS
# note: DESIGN

# group: ENTER VIEW'S NAME
# note: Not necessary the entire name, but in sufficient length to identify the view specifically
enter_view_s_name = StringInput("PROPOSED FLOOR PLAN - L00 - WORKING ONLY")

# group: FILTER VIEWS
code_block = CodeBlock { "OST_Views"; }
byName = Category.ByName(code_block)
all_elements_of_category = ElementsOfCategory(byName)
string_from_object = FromObject(all_elements_of_category)
code_block_2 = CodeBlock { true; }
contains = String.Contains(str=string_from_object, searchFor=enter_view_s_name, ignoreCase=code_block_2)
filterByBoolMask = List.FilterByBoolMask(list=all_elements_of_category, mask=contains)
firstItem = List.FirstItem(filterByBoolMask.in)

# group: SELECT PARKING BAYS BY CATEGORY
code_block_3 = CodeBlock { "OST_Parking"; }
byName_2 = Category.ByName(code_block_3)
all_elements_of_category_2 = ElementsOfCategory(byName_2)

# group: FILTER OUT THE SHARED AREA OF THE ACCESSIBLE PARKINGS
string_from_object_2 = FromObject(all_elements_of_category_2)
unique_fragment_of_text_from_the = CodeBlock { "SHARED AREA"; }  # "Unique fragment of text from the Accessible parking bay family's name"
contains_2 = String.Contains(str=string_from_object_2, searchFor=unique_fragment_of_text_from_the)
filterByBoolMask_2 = List.FilterByBoolMask(list=all_elements_of_category_2, mask=contains_2)

# group: COUNT NUMBER OF PARKING SPACES AND CREATE LIST TO USE AS MARKS
parameter_s_name_to_fill = CodeBlock { "Mark"; }
count = Count(filterByBoolMask_2.out)
code_block_4 = CodeBlock(a=count) { 1..a; }
string_from_object_3 = FromObject(code_block_4)

# group: WRITE THE MARK NUMBER TO EACH PARKING
setParameterByName = Element.SetParameterByName(element=filterByBoolMask_2.out, parameterName=parameter_s_name_to_fill, value=string_from_object_3)

# group: TAG ALL PARKING SPACES
code_block_5 = CodeBlock { true; false; "center"; "center"; }
byElement = Tag.ByElement(firstItem, setParameterByName, code_block_5.out0, code_block_5.out1, code_block_5.out2, code_block_5.out3)
