# Dynamo graph PLACE VIEWS ON NEW SHEETS.dyn (Dynamo 1.3.2.2480)

# note: Instrucciones:
# 1. Descargar nodo SteamNode y MEPover de Paquetes>Buscar un paquete (omitir paso si están los paquetes en red y se ven en la librería)
# 2. Seleccionar Cuadro de rotulación, Tipo de vista a colocar en los planos, Rellenar alguna/s palabra/s clave para el filtrado de vistas, El nombre de los planos, automáticamente se les numerará consecutivamente y Número de plano inicial

# group: input
tipo_de_vista_a_colocar_en = ViewTypesUi("FloorPlan")  # "Tipo de vista a colocar en planos"
getByType = archilab.Revit.Views.View.GetByType(tipo_de_vista_a_colocar_en)

# group: filter all views
string_from_object = FromObject(getByType)
palabra_s_clave_para_filtrado = StringInput("1/10 C")  # "Palabra/s clave para filtrado vistas"
code_block = CodeBlock { true; }
contains = String.Contains(str=string_from_object, searchFor=palabra_s_clave_para_filtrado, ignoreCase=code_block)
filterByBoolMask = List.FilterByBoolMask(list=getByType, mask=contains)

# group: number of views and sheets and titleblock
nombre_de_planos = StringInput("PLANTA")
count = Count(filterByBoolMask.in)
cycle = List.Cycle(list=nombre_de_planos, amount=count)
code_block_2 = CodeBlock(z=count) { 1..z; }
string_from_object_2 = FromObject(code_block_2)
code_block_3 = CodeBlock(a=cycle, b=string_from_object_2) { a + " " + b; }
prefijo_planos = StringInput("E")
string_from_object_3 = FromObject(code_block_2)
code_block_4 = CodeBlock(a=prefijo_planos, b=string_from_object_3) { a + "-" + b; }

# group: get first view crop box and set the other views as this one
code_block_5 = CodeBlock { "Recortar vista"; true; }
setParameterByName = Element.SetParameterByName(element=filterByBoolMask.in, parameterName=code_block_5.out0, value=code_block_5.out1)

firstItem = List.FirstItem(filterByBoolMask.in)
getCropBoxCurves = Custom[View.GetCropBoxCurves](Views=firstItem)  # returns the curves of a view crop box, even irregular shapes. Returns an empty list if the crop view is not active for a given view
byJoinedCurves = PolyCurve.ByJoinedCurves(getCropBoxCurves)
setCropBoxCurves = Custom[View.SetCropBoxCurves](Views=setParameterByName@L1, Curves=byJoinedCurves)  # Input views and lists of curves to set the view crop regions
cropView = Custom[View.CropView](Views=setParameterByName)  # Crop a 3D view

# group: 3D views or not?
no_tocar = ViewTypesUi("ThreeD")
ne = tipo_de_vista_a_colocar_en != no_tocar
if_ = CodeBlock(x=ne, y=setCropBoxCurves, z=cropView) { oldif(x,y,z); }
code_block_6 = CodeBlock()
# ---------- code_block_6.designscript (15 lines) ----------
def oldif(test, iftrue:var[]..[],
iffalse:var[]..[])
{
return = [Imperative]
{
if (test)
{
return = iftrue;
}
else
{
return = iffalse;
}
}
};
# ----------------------------------------

# group: place views on sheet and align viewport center
cuadro_de_rotulación = FamilyTypes()
byNameNumberTitleBlockAndViews = Sheet.ByNameNumberTitleBlockAndViews(code_block_3, code_block_4, cuadro_de_rotulación, if_, lacing=Longest)

# group: get first view reference box and set the other views as this one
code_block_7 = CodeBlock { "Caja de referencia"; }
firstItem_2 = List.FirstItem(filterByBoolMask.in)
getParameterValueByName = Element.GetParameterValueByName(element=firstItem_2, parameterName=code_block_7)
setParameterByName_2 = Element.SetParameterByName(element=filterByBoolMask.in, parameterName=code_block_7, value=getParameterValueByName)
