# Dynamo graph PLACE VIEWS ON SHEETS.dyn (Dynamo 1.3.2.2480)

# group: input
# note: Instrucciones:
# 1. Descargar nodo SteamNode de Paquetes>Buscar un paquete (omitir paso si los paquetes están en el servidor)
# 2. Crear un plano en Revit para usarlo de referencia. Poner en ella sólo una vista que servirá de referencia para colocar los nuevas vistas en los planos.
# 3. Preparar la vista con una caja de referencia asignada en Propiedades>Extensión>Caja de referencia. Para crear dicha caja de de referencia; Vista>Crear>Caja de referencia
# 4. Seleccionar Cuadro de rotulación, Tipo de vista a usar, Plano de referencia a usar, escribir alguna/s palabra/s clave para el filtrado de vistas y el nombre de los planos al que automáticamente se les numerará.
code_block = CodeBlock { "OST_Sheets"; }
byName = Category.ByName(code_block)
all_elements_of_category = ElementsOfCategory(byName)
tipo_de_vista_a_colocar_en = ViewTypesUi("FloorPlan")  # "Tipo de vista a colocar en planos"
getByType = archilab.Revit.Views.View.GetByType(tipo_de_vista_a_colocar_en)
posición_x_de_vista_en_cm = DoubleInput(10)
posición_y_de_vista_en_cm = DoubleInput(10)

# group: filter input sheets
sheetNumber = Sheet.SheetNumber(all_elements_of_category)
string_from_object = FromObject(sheetNumber)
palabra_s_clave_filtrado_planos = StringInput("E")
code_block_2 = CodeBlock { true; }
contains = String.Contains(str=string_from_object, searchFor=palabra_s_clave_filtrado_planos, ignoreCase=code_block_2)
filterByBoolMask = List.FilterByBoolMask(list=all_elements_of_category, mask=contains)

# group: filter input views
string_from_object_2 = FromObject(getByType)
palabra_s_clave_filtrado_vistas = StringInput("Planimetría general c")
code_block_3 = CodeBlock { true; }
contains_2 = String.Contains(str=string_from_object_2, searchFor=palabra_s_clave_filtrado_vistas, ignoreCase=code_block_3)
filterByBoolMask_2 = List.FilterByBoolMask(list=getByType, mask=contains_2)

code_block_4 = CodeBlock { 1..41..1; }
sortByKey = List.SortByKey(list=filterByBoolMask_2.in, keys=code_block_4)

# group: convert centimeters to feet
convertir_centímetros_a_pies = CodeBlock(a=posición_x_de_vista_en_cm) { a/32.8084; }
convertir_centímetros_a_pies_2 = CodeBlock(a=posición_y_de_vista_en_cm) { a/32.8084; }

code_block_5 = CodeBlock { 0; }
byCoordinates = Point.ByCoordinates(x=convertir_centímetros_a_pies, y=convertir_centímetros_a_pies_2, z=code_block_5)
count = List.Count(filterByBoolMask_2.in)
cycle = List.Cycle(list=byCoordinates, amount=count)

# group: Place Views on a Sheet
code_block_6 = CodeBlock { true; }
code_block_7 = CodeBlock(Run=code_block_6, Sheet=filterByBoolMask.in, Views=sortByKey.sorted_list, Locations=cycle) { Run; Sheet; Views; Locations; }
python_script = Python(IN[0]=code_block_7.Run, IN[1]=code_block_7.Sheet, IN[2]=code_block_7.Views, IN[3]=code_block_7.Locations)
# ---------- python_script.python (52 lines) ----------
################### Import References ###################
import clr

clr.AddReference("RevitServices")
import RevitServices
from RevitServices.Persistence import DocumentManager
from RevitServices.Transactions import TransactionManager
doc =  DocumentManager.Instance.CurrentDBDocument
app = DocumentManager.Instance.CurrentUIApplication.Application

clr.AddReference("RevitNodes")
import Revit
clr.ImportExtensions(Revit.Elements)
clr.ImportExtensions(Revit.GeometryConversion)

clr.AddReference("RevitAPI")
from Autodesk.Revit.DB import *
################### Definitions ###################
def tolist(obj1):
	if hasattr(obj1,"__iter__"): return obj1
	else: return [obj1]
################### Inputs ###################
#get the bool in port IN[0]...
r = tolist(IN[0])
r = r[0]
#get the sheet in port IN[1] and UnwrapElement if not already...
sheets = tolist(UnwrapElement(IN[1]))
#get the views in port IN[1] and UnwrapElement if not already...
views = tolist(UnwrapElement(IN[2]))
#get the points in port IN[2] (no need to unwrap as these are Dynamo Points)...
locs = tolist(IN[3])

################### Outputs ###################
outList = []

################### Script ###################
if r:
	if len(views) == len(locs):
		for sht,v,l in zip(sheets, views, locs):
			TransactionManager.Instance.EnsureInTransaction(doc)
			try:
				if Viewport.CanAddViewToSheet(doc,sht.Id,v.Id):
					vp = Viewport.Create(doc,sht.Id,v.Id,l.ToXyz())
					outList.append(vp)
			except Exception, e:
				outList.append(e.message)
			TransactionManager.Instance.TransactionTaskDone()
		OUT = outList
	else:
		OUT = "Number of Views must match the number of Locations"
else:
	OUT = "Set Run to True"
# ----------------------------------------

watch = Watch(filterByBoolMask_2.in)
firstItem = List.FirstItem(watch)
firstItem_2 = List.FirstItem(filterByBoolMask.in)
place_schedules_on_sheet = Python(IN[0]=firstItem, IN[1]=firstItem_2)
# ---------- place_schedules_on_sheet.python (32 lines) ----------
import clr

# Import DocumentManager
clr.AddReference('RevitServices')
import RevitServices
from RevitServices.Persistence import DocumentManager
from RevitServices.Transactions import TransactionManager

doc = DocumentManager.Instance.CurrentDBDocument

# Import RevitNodes/Import ToDSType(bool) extension method
clr.AddReference("RevitNodes")
import Revit
clr.ImportExtensions(Revit.Elements)

# Import RevitAPI
clr.AddReference('RevitAPI')
from Autodesk.Revit.DB import ScheduleSheetInstance

schedule1 = UnwrapElement(IN[0])
sheets = UnwrapElement(IN[1])
schedule_id = schedule1.ScheduleId
schedule_pt = schedule1.Point
schedules = []

TransactionManager.Instance.EnsureInTransaction(doc)
for sheet in sheets:
	ns1 = ScheduleSheetInstance.Create(doc, sheet.Id, schedule_id, schedule_pt)
	schedules.append(ns1.ToDSType(False))
TransactionManager.Instance.TransactionTaskDone()

OUT = schedules
# ----------------------------------------
string_from_object_3 = FromObject(filterByBoolMask_2.in)
code_block_8 = CodeBlock { " "; }
split = String.Split(string_from_object_3, code_block_8)
count_2 = Count(split@L2)
code_block_9 = CodeBlock(a=count_2) { a-2; }
getItemAtIndex = List.GetItemAtIndex(list=split@@L2, index=code_block_9@L1)
toNumber = String.ToNumber(getItemAtIndex)
flatten = Flatten(toNumber)
sort = List.Sort(flatten)
