# Dynamo graph RENAME GRIDS.dyn (Dynamo 1.2.1.3083)

# group: DESIGN
# note: BACK-END FUNCTIONALITY

# group: USER INTERFACE
# note: INPUT + CONTROL

# group: WIP
# note: USE:
# FOR UNFINISHED OR UNTESTED
# NODE BLOCKS
# note: WIP

# group: COMMENTS
# note: USE:
# FOR ANY COMMENTS OR PROJECT INFO
# note: COMMENTS

# group: TO REVIT
# note: USE:
# FOR ANY NODE THAT
# EXPORTS DATA TO REVIT
# note: TO REVIT

# group: INPUT
# note: USE:
# FOR FIXED INPUTS, LIKE FILE PATHS OR FIXED NUMBERS OR ELEMENTS THAT NEEDS TO BE
# TYPED BY THE FINAL USER
# note: INPUT

# group: CONTROL
# note: FIXED INPUTS THAT DICTATE WHAT
# THE SCRIPT IS USEFUL FOR
# note: CONTROL

# group: DESIGN
# note: USE:
# FOR GENERAL DEFINITIONS OF NODE BLOCKS
# note: DESIGN

# group: MATRIX ALONG CURVE
# note: CREATED BY:
# CREATED: 2018.08.15
# VERSION: 1.0
# LAST EDITED: 2019.01.11
# DYNAMO VERSION: Dynamo 1.2.0
# PACKAGES:
# Rythm
# NOTES:

# group: INSTRUCTIONS
# note: INSTRUCTIONS:
# 1. Fill in the required fields inside the yellow group
# 2. Click on Run
# 3. Select the grids to rename, the selection square will only pick up grids
# 4. Click Finish in the option bar

# group: INPUT
reverse_grid_order = BoolSelector(false)
grid_suffix_number_or_letter = StringInput("1")
grid_prefix_number_or_letter = StringInput("A")
separator = StringInput("-")

# group: SELECT GRIDS
code_block = CodeBlock { "OST_Grids"; }
byName = Category.ByName(code_block)
# note: Rhythm
isolated_pick_model_elements = Custom[Isolated Pick Model Elements](Category=byName)  # This allows a multiple selection of elements of specified category.

# group: REVERSE ORDER?
reverse = List.Reverse(isolated_pick_model_elements)
IF = Python(IN[0]=reverse_grid_order, IN[1]=reverse, IN[2]=isolated_pick_model_elements)
# ---------- IF.python (17 lines) ----------
import clr
clr.AddReference('ProtoGeometry')
from Autodesk.DesignScript.Geometry import *
#The inputs to this node will be stored as a list in the IN variables.
data1 = IN[0]
data2 = IN[1]
data3 = IN[2]

result = list()

if data1 == True:
	result = data2
else:
	result = data3

#Assign your output to the OUT variable.
OUT = result
# ----------------------------------------

# group: RENAME GRIDS TO AVOID NAME CONFLICTS
code_block_2 = CodeBlock { "Name"; }
count = Count(IF)
code_block_3 = CodeBlock(a=count) { 1..a; }
string_from_object = FromObject(code_block_3)
setParameterByName = Element.SetParameterByName(element=IF, parameterName=code_block_2, value=string_from_object)

# group: NUMBER OR STRING AS NEW NAME
toNumber = String.ToNumber(grid_suffix_number_or_letter)
type = Object.Type(toNumber)
code_block_4 = CodeBlock { null; }
eq = type == code_block_4
count_2 = Count(setParameterByName)
code_block_5 = CodeBlock(a=grid_suffix_number_or_letter, d=count_2) { a..#d..1; }
code_block_6 = CodeBlock(a=grid_prefix_number_or_letter, b=separator, c=code_block_5) { a+b+c; }
count_3 = Count(setParameterByName)
code_block_7 = CodeBlock(a=toNumber, d=count_3) { a..#d..1; }
code_block_8 = CodeBlock(a=grid_prefix_number_or_letter, b=separator, c=code_block_7) { a+b+c; }
IF_2 = Python(IN[0]=eq, IN[1]=code_block_6, IN[2]=code_block_8)  # same code as IF

# group: SET NEW NAMES
code_block_9 = CodeBlock { "Name"; }
setParameterByName_2 = Element.SetParameterByName(element=setParameterByName, parameterName=code_block_9, value=IF_2)
