# Dynamo graph RENUMBER DOORS.dyn (Dynamo 1.2.1.3083)

# group: USER INTERFACE
# note: INPUT + CONTROL

# group: DESIGN
# note: BACK-END FUNCTIONALITY

# group: ROOM NUMBER IN DOORS AND WINDOWS
# note: CREATED BY:
# CREATED: 2018.08.15
# VERSION: 1.0
# LAST EDITED: 2018.08.15
# DYNAMO VERSION: Dynamo 1.2.0
# PACKAGES:
# Clockwork
# NOTES:
# <NOTES>

# group: INSTRUCTIONS
# note: INSTRUCTIONS:
# 1. Select phase of the doors and windows
# 2. Click Run

# group: WIP
# note: USE:
# FOR UNFINISHED OR UNTESTED
# NODE BLOCKS
# note: WIP

# group: COMMENTS
# note: USE:
# FOR ANY COMMENTS OR PROJECT INFO
# note: COMMENTS

# group: TO REVIT
# note: USE:
# FOR ANY NODE THAT
# EXPORTS DATA TO REVIT
# note: TO REVIT

# group: INPUT
# note: USE:
# FOR FIXED INPUTS, LIKE FILE PATHS OR FIXED NUMBERS OR ELEMENTS THAT NEEDS TO BE
# TYPED BY THE FINAL USER
# note: INPUT

# group: CONTROL
# note: FIXED INPUTS THAT DICTATE WHAT
# THE SCRIPT IS USEFUL FOR
# note: CONTROL

# group: DESIGN
# note: USE:
# FOR GENERAL DEFINITIONS OF NODE BLOCKS
# note: DESIGN

# group: SELECT ALL DOORS
code_block = CodeBlock { "OST_Doors"; }
byName = Category.ByName(code_block)
all_elements_of_category = ElementsOfCategory(byName)

# group: INPUT
select_phase = RevitPhases("New Construction")

# group: GET DOORS IN ROOMS
rooms = Custom[Door.Rooms](door=all_elements_of_category, phase=select_phase)  # Gets the rooms that are connected by a given door
python_script = Python(IN[0]=rooms.toRoom)
# ---------- python_script.python (15 lines) ----------
import clr
clr.AddReference('ProtoGeometry')
from Autodesk.DesignScript.Geometry import *
#The inputs to this node will be stored as a list in the IN variables.
data1 = IN

resultList = []

for element in data1[0]:
	if element == []:
		resultList.append(False)
	else:
		resultList.append(True)
#Assign your output to the OUT variable.
OUT = resultList
# ----------------------------------------
filterByBoolMask = List.FilterByBoolMask(list=all_elements_of_category, mask=python_script)
code_block_2 = CodeBlock { "Door Room Number"; }
filterByBoolMask_2 = List.FilterByBoolMask(list=rooms.toRoom, mask=python_script)
number = Room.Number(filterByBoolMask_2.in)

# group: SET RESULTS IN REVIT
setParameterByName = Element.SetParameterByName(element=filterByBoolMask.in, parameterName=code_block_2, value=number)

# group: CREATE LIST OF NUMBERS TO RENUMBER ROOMS
code_block_3 = CodeBlock { "Door Room Number"; }
getParameterValueByName = Element.GetParameterValueByName(parameterName=code_block_3)  # unwired: element
groupByFunction = GroupByFunction(setParameterByName, getParameterValueByName)
code_block_4 = CodeBlock { "Mark"; }
code_block_5 = CodeBlock { "0"; }
count = Count(groupByFunction@L2)
code_block_6 = CodeBlock(a=count) { 01..a; }
code_block_7 = CodeBlock(a=code_block_5, b=code_block_6) { a+b; }

# group: SET RESULTS IN REVIT
setParameterByName_2 = Element.SetParameterByName(element=groupByFunction, parameterName=code_block_4, value=code_block_7)

# group: SELECT ALL WINDOWS
code_block_8 = CodeBlock { "OST_Windows"; }
byName_2 = Category.ByName(code_block_8)
all_elements_of_category_2 = ElementsOfCategory(byName_2)

# group: GET WINDOWS IN ROOMS
rooms_2 = Custom[Window.Rooms](window=all_elements_of_category_2, phase=select_phase)  # Gets the rooms that are connected by a given window
code_block_9 = CodeBlock { "Window Room Number"; }

python_script_2 = Python(IN[0]=rooms_2.toRoom)  # same code as python_script

# group (continued): GET WINDOWS IN ROOMS
filterByBoolMask_3 = List.FilterByBoolMask(list=all_elements_of_category_2, mask=python_script_2)
filterByBoolMask_4 = List.FilterByBoolMask(list=rooms_2.toRoom, mask=python_script_2)
number_2 = Room.Number(filterByBoolMask_4.in)

# group: SET RESULTS IN REVIT
setParameterByName_3 = Element.SetParameterByName(element=filterByBoolMask_3.in, parameterName=code_block_9, value=number_2)

# group: CREATE LIST OF NUMBERS TO RENUMBER ROOMS
code_block_10 = CodeBlock { "Window Room Number"; }
getParameterValueByName_2 = Element.GetParameterValueByName(parameterName=code_block_10)  # unwired: element
groupByFunction_2 = GroupByFunction(setParameterByName_3, getParameterValueByName_2)
code_block_11 = CodeBlock { "Mark"; }
code_block_12 = CodeBlock { "0"; }
count_2 = Count(groupByFunction_2@L2)
code_block_13 = CodeBlock(a=count_2) { 1..a; }
code_block_14 = CodeBlock(a=code_block_12, b=code_block_13) { a+b; }

# group: SET RESULTS IN REVIT
setParameterByName_4 = Element.SetParameterByName(element=groupByFunction_2, parameterName=code_block_11, value=code_block_14)
