# Dynamo graph REVISIONS ON SHEETS.dyn (Dynamo 1.2.1.3083)

# group: USER INTERFACE
# note: INPUT + CONTROL

# group: DESIGN
# note: BACK-END FUNCTIONALITY

# group: ADD REVISIONS TO SHEETS
# note: CREATED BY:
# CREATED: 2018.08.15
# VERSION: 1.0
# LAST EDITED: 2018.08.15
# DYNAMO VERSION: Dynamo 1.2.0
# PACKAGES:
# None
# NOTES:
# <NOTES>

# group: INSTRUCTIONS
# note: INSTRUCTIONS:
# 1. Write down the series of sheets to add revision
# 2. Fill in "add" or "remove"
# 3. Select revision to place on the sheets
# 4. Click Run

# group: WIP
# note: USE:
# FOR UNFINISHED OR UNTESTED
# NODE BLOCKS
# note: WIP

# group: COMMENTS
# note: USE:
# FOR ANY COMMENTS OR PROJECT INFO
# note: COMMENTS

# group: TO REVIT
# note: USE:
# FOR ANY NODE THAT
# EXPORTS DATA TO REVIT
# note: TO REVIT

# group: INPUT
# note: USE:
# FOR FIXED INPUTS, LIKE FILE PATHS OR FIXED NUMBERS OR ELEMENTS THAT NEEDS TO BE
# TYPED BY THE FINAL USER
# note: INPUT

# group: CONTROL
# note: FIXED INPUTS THAT DICTATE WHAT
# THE SCRIPT IS USEFUL FOR
# note: CONTROL

# group: DESIGN
# note: USE:
# FOR GENERAL DEFINITIONS OF NODE BLOCKS
# note: DESIGN

# group: SELECT ALL SHEETS
code_block = CodeBlock { "OST_Sheets"; }
byName = Category.ByName(code_block)
all_elements_of_category = ElementsOfCategory(byName)

# group: INPUT
# note: Write Add or Remove:
# Add = add revisions on selected sheets or serie of sheets
# Remove = delete revisions on selected sheets
sheet_number_for_series_just = StringInput("A")  # "Sheet Number (for series just enter prefix A for WD or TP for Town Planning)"
select_revision = RevitRevisions("Seq. 1 - Revision 1")
add_or_remove = StringInput("Add")

# group: FILTER SHEETS
sheetNumber = Sheet.SheetNumber(all_elements_of_category)
contains = String.Contains(str=sheetNumber, searchFor=sheet_number_for_series_just)
filterByBoolMask = List.FilterByBoolMask(list=all_elements_of_category, mask=contains)

toLower = String.ToLower(add_or_remove)
code_block_2 = CodeBlock { "remove"; }
eq = toLower == code_block_2
code_block_3 = CodeBlock { true; false; }
if_ = If(test=eq, true=code_block_3.out0, false=code_block_3.out1)
remove_revision_from_sheet = Custom[Remove Revision from Sheet](Sheet=filterByBoolMask.in, Revision=select_revision, RunIt=if_)  # This node will remove specified Revisions from a sheet.
code_block_4 = CodeBlock { "add"; }
eq_2 = toLower == code_block_4
if_2 = If(test=eq_2, true=code_block_3.out0, false=code_block_3.out1)
add_revisions_to_sheet = Custom[Add Revisions to Sheet](Sheet=filterByBoolMask.in, Revision=select_revision, RunIt=if_2)  # This node will add specified revisions to a sheet.
