# Dynamo graph Remove or Move Revit Backup Files.dyn (Dynamo 2.0.2.6826)

# group: USER INTERFACE
# note: INPUT + CONTROL

# group: DESIGN
# note: BACK-END FUNCTIONALITY

# group: SCRIPT NAME
# note: CREATED BY:
# CREATED: 2019-01-21
# VERSION: 1.0
# LAST EDITED: 2019-01-21
# DYNAMO VERSION: 2.0
# PACKAGES:
# NOTES:

# group: INSTRUCTIONS
# note: INSTRUCTIONS:
# 1. Select the folder to clean. All subfolders will be cleaned too.
# 2. Select delete or move the files.
# 3. If Move is selected, choose the folder to move all the Revit backup files.
# 4. Click Run.

# group: WIP
# note: USE:
# FOR UNFINISHED OR UNTESTED
# BLOCKS OF CODE
# note: WIP

# group: COMMENTS
# note: USE:
# FOR ANY COMMENTS OR PROJECT INFO
# note: COMMENTS

# group: TO REVIT
# note: USE:
# FOR ANY GROUP THAT
# WRITES DATA TO REVIT
# note: TO REVIT

# group: INPUT
# note: USE:
# INPUTS THAT ARE REQUIRED TO BE
# DECLARED BY THE USER
# note: INPUT

# group: DESIGN
# note: USE:
# FOR GENERAL DEFINITIONS OF NODE BLOCKS
# note: DESIGN

# group: USER SELECTION
library_path = Directory("D:\revit library")  # graph input
delete_true_or_move_false = BoolSelector(true)  # graph input
backup_path_case_move_option = Directory("D:\Backup Folder")  # "Backup path (case Move option selected)"; graph input

# group: PYTHON SCRIPT TO CLEAN DIRECTORY
python_script_to_remove_or_move = Python(IN[0]=library_path, IN[1]=delete_true_or_move_false, IN[2]=backup_path_case_move_option)  # "Python Script to Remove or Move Revit Backup Files"; graph output; unwired: IN[3]
# ---------- python_script_to_remove_or_move.python (52 lines) ----------
# Import sys module and assign the right path for the IronPython Library
import sys
sys.path.append(r"C:\Program Files (x86)\IronPython 2.7\Lib")
# Import os module to get directories
import os
# Import re module to match file extensions
import re
# Import shutil module to move files
import shutil

# The inputs to this node will be stored as a list in the IN variables.
directory = IN[0]
delMov = IN[1]
backupDir = IN[2]

# Empty list to store the filenames that have been removed or moved
modFiles = list()

# Function to clean the backup files
def directoryClean():
	# Collect all files in directory and subdirectories
	for folderName, subFolders, files in os.walk(directory):
		# Pattern to check against if file is a revit family or project backup
		matchBackups = re.compile(r'.*\.\d+.r(vt|fa)$')
		# Loop over the files
		for file in files:
			# Assign the matched files to a variable
			matched = matchBackups.search(file)
			# If the file is a match
			if matched:
				# Get the original filepath for the file
				filePath = os.path.join(folderName, file)
				# Get the destination filepath for the file (move will overwrite previous versions if full path is provided)
				backupPath = os.path.join(backupDir, file)
				# Change matched files permission to writable
				os.chmod(filePath, 436)
				# Append modified elements to modFiles list
				modFiles.append(file)
				# Case False: Move backup files
				if delMov == False:
					# Move matched files
					shutil.move(filePath, backupPath)
				# Case True: Delete backup files
				else:
					# Delete matched files
					os.unlink(filePath)

# Call the function to execute
directoryClean()

#Assign your output to the OUT variable.
OUT = modFiles
# ----------------------------------------
