# Dynamo graph SCHEDULE REVISION HISTORY.dyn (Dynamo 1.3.2.2480)

# group: input
# note: Instrucciones:
# 1. Descargar los nodos Archi-lab_Grinshaw y Clockwork de Paquetes>Buscar un paquete
# 2.
# 3. Crear la lista de planos con los correspondientes campos y los parámetros anteriormente creados
# 4. Ejecutar este archivo de Dynamo
# 5. Si se cambia valores en Revit y al volver a ejecutar este archivo no actualiza la tabla correspondiente, cerrar Dynamo y volver a abrir para ejecutarlo de nuevo
# 6. Para exportar el historial de revisiones a Excel a otra ubicación deseada, seleccionar el nodo File Path dentro del grupo Exportar tabla a Excel y seleccionar nueva ruta y nombre deseado
code_block = CodeBlock { true; }
# note: Nodo Archi-lab
get_all_revisions = Custom[Get All Revisions](RunIt=code_block)  # This node will return all Revisions currently defined in the mode.
revision_properties = Custom[Revision Properties](Revision=get_all_revisions)  # This node will return some most common Revision properties like Description or Issue Date.
code_block_2 = CodeBlock { Category.ByName("OST_Sheets"); }
all_elements_of_category = ElementsOfCategory(code_block_2)

# group: filter sheets by parameter 'appears in drawing list'
code_block_3 = CodeBlock { "Aparece en la lista de planos"; }
getParameterValueByName = Element.GetParameterValueByName(element=all_elements_of_category, parameterName=code_block_3)
string_from_object = FromObject(getParameterValueByName)
code_block_4 = CodeBlock { "0"; true; }
contains = String.Contains(str=string_from_object, searchFor=code_block_4.out0, ignoreCase=code_block_4.out1)
filterByBoolMask = List.FilterByBoolMask(list=all_elements_of_category, mask=contains)

# group: sheet parameters on schedule
code_block_5 = CodeBlock { "Observaciones"; }
getParameterValueByName_2 = Element.GetParameterValueByName(element=filterByBoolMask.out, parameterName=code_block_5)
code_block_6 = CodeBlock { "Número de plano"; }
getParameterValueByName_3 = Element.GetParameterValueByName(element=filterByBoolMask.out, parameterName=code_block_6)
code_block_7 = CodeBlock { "Nombre de plano"; }
getParameterValueByName_4 = Element.GetParameterValueByName(element=filterByBoolMask.out, parameterName=code_block_7)
# note: Clockwork
scale = Custom[Sheet.Scale](sheet=filterByBoolMask.out)  # Returns the scale of a given sheet
code_block_8 = CodeBlock { "Escalas varias"; }
code_block_9 = CodeBlock(val=scale, cat=code_block_8, x=scale) { val == "Como se indica" ? cat : x; }
code_block_10 = CodeBlock { "Fecha de emisión del plano"; }
getParameterValueByName_5 = Element.GetParameterValueByName(element=filterByBoolMask.out, parameterName=code_block_10)

# group: extract revisions on sheets
revisions = archilab.Revit.Views.Sheet.Revisions(filterByBoolMask.out)
setIntersection = SetIntersection(revisions, get_all_revisions)
containsItem = List.ContainsItem(list=setIntersection, item=get_all_revisions, lacing=CrossProduct)
count = Count(filterByBoolMask.out)
cycle = List.Cycle(list=revision_properties.Description, amount=count)
code_block_11 = CodeBlock(a=containsItem, b=cycle) { checkrevision(a,b); }
code_block_12 = CodeBlock()
# ---------- code_block_12.designscript (5 lines) ----------
def checkrevision(a : var[],b : var[])
{
v = a ==true? b : null;
return = v;
};
# ----------------------------------------

# group: write new schedule in Revit shared parameters
count_2 = Count(get_all_revisions)
code_block_13 = CodeBlock(nm=count_2) { 1..nm..1; }
cycle_2 = List.Cycle(list=code_block_13, amount=count)
chop = List.Chop(list=cycle_2, lengths=count_2)
string_from_object_2 = FromObject(chop)

# group: order revisions on sheets
code_block_14 = CodeBlock { "RV"; }
code_block_15 = CodeBlock(n=count_2) { 1..n..1; }
add = code_block_14 + code_block_15
code_block_16 = CodeBlock(a=add, b=revision_properties.Description) { a+" "+b; }
flatten = Flatten(code_block_16)
code_block_17 = CodeBlock { null; }
ne = code_block_11 != code_block_17
code_block_18 = CodeBlock(rev_description=flatten, boolean_mask=ne) { rev_description; boolean_mask; }
match_item_at_sublist = Python(IN[0]=code_block_18.boolean_mask, IN[1]=code_block_18.rev_description)
# ---------- match_item_at_sublist.python (27 lines) ----------
import clr
clr.AddReference('ProtoGeometry')
from Autodesk.DesignScript.Geometry import *
#Las entradas de este nodo se almacenan como lista en las variables IN.
dataEnteringNode = IN

Test = IN[0]
Name = IN[1]

result = []


for item in Test:
	index = 0
	
	resultlist = []
	for x in item:
		if x == True:
			resultlist.append(Name[index])
			index = index+1
		else:
			resultlist.append(None)
	result.append(resultlist)


#Asigne la salida a la variable OUT.
OUT = result
# ----------------------------------------

# group: revision history on sheets schedule
code_block_19 = CodeBlock()
# ---------- code_block_19.designscript (3 lines) ----------
{"NÚMERO DE PLANO", "NOMBRE DE PLANO",
"ESCALA","FECHA"};
"OBSERVACIONES";
# ----------------------------------------
join = List.Join(code_block_19.out0, revision_properties.Sequence, code_block_19.out1)
flatten_2 = Flatten(join@L3)
create = List.Create(getParameterValueByName_3, getParameterValueByName_4, code_block_9, getParameterValueByName_5)
transpose = List.Transpose(match_item_at_sublist)
join_2 = List.Join(create, transpose)
addItemToEnd = List.AddItemToEnd(item=getParameterValueByName_2, list=join_2)
# note: Clockwork
sortListOfLists = Custom[List.SortListOfLists](seq=addItemToEnd)  # Sorts a list of lists by one of its sublists
transpose_2 = List.Transpose(sortListOfLists)
join_3 = List.Join(flatten_2, transpose_2)

# group: export revision history on sheets to Excel
ruta_para_escribir_el_archivo = Filename("C:\Users\fechevarria\Desktop\Historial Revisiones.xlsx")  # "Ruta para escribir el archivo Excel"
code_block_20 = CodeBlock { "REVISIONES EN PLANO"; 1; 0; true; }
writeToFile = Excel.WriteToFile(filePath=ruta_para_escribir_el_archivo, sheetName=code_block_20.out0, startRow=code_block_20.out1, startCol=code_block_20.out2, data=join_3, overWrite=code_block_20.out3)

# group (continued): write new schedule in Revit shared parameters
setParameterByName = Element.SetParameterByName(element=filterByBoolMask.out, parameterName=string_from_object_2, value=match_item_at_sublist)

# group: erase previous revision data in shared or project parameters
code_block_21 = CodeBlock { true; }
# note: Archi-lab
get_all_revisions_2 = Custom[Get All Revisions](RunIt=code_block_21)
count_3 = Count(get_all_revisions_2)
code_block_22 = CodeBlock(nm=count_3) { 1..nm..1; }
string_from_object_3 = FromObject(code_block_22)
count_4 = Count(filterByBoolMask.out)
cycle_3 = List.Cycle(list=string_from_object_3, amount=count_4)
chop_2 = List.Chop(list=cycle_3, lengths=count_3)
string_from_object_4 = FromObject(chop_2)
getParameterValueByName_6 = Element.GetParameterValueByName(element=filterByBoolMask.out, parameterName=string_from_object_3, lacing=CrossProduct)
string_from_object_5 = FromObject(getParameterValueByName_6)
code_block_23 = CodeBlock { ""; }
eq = _ == _  # unwired: arg0, arg1
replaceByCondition = Replace(string_from_object_5, code_block_23, eq)
setParameterByName_2 = Element.SetParameterByName(element=filterByBoolMask.out, parameterName=string_from_object_4, value=replaceByCondition)
# note: Clockwork
passthrough = Custom[Passthrough](passThrough=setParameterByName, waitFor=setParameterByName_2)  # Forces a sequential order of execution. The node wired into the output of the Passthrough node will be executed *after* the node wired into the waitFor input (e.g. important for some Revit operations). The value of the passThrough input will be passed on to the node wired into the output port of the Passthrough node.
